# Grasshopper definition GrasshopperScript.gh (Grasshopper 1.0.7)
# plug-ins: MeshEdit Components, Human, Kangaroo Components, LunchBox, Weaverbird, Kangaroo2 Components

# ----
# Model 1
number_slider = Slider(1, range=0..1)
mesh_plane = MeshPlane(
    Boundary={Plane=PlaneXY(0, 0, 0), Size=Domain2(u=-10..10, v=-10..10)},
    WidthCount=number_slider,
    HeightCount=Slider(2, range=0..10))  # -> Mesh, Area
shell = Mesh(mesh_plane.Mesh)
refine = Refine(Mesh=shell, Level="0")
mesh = Mesh(refine)
clean = CombineClean(Meshes=mesh)
deconstruct_mesh = DeconstructMesh(Mesh=clean)  # -> Vertices, Faces, Colours, Normals
removeduplicatepts = RemoveDuplicatePts(Points=flatten(deconstruct_mesh.Vertices), Tolerance=0.01)
pdecon = Deconstruct(Point=removeduplicatepts)  # -> XComponent, YComponent, ZComponent
explode = MeshExplode(Mesh=clean, Interpolate=False)  # -> flatten(Faces)
smaller_than = SmallerThan(FirstNumber=pdecon.XComponent, SecondNumber=Slider(0.01, range=0..0.01))  # -> SmallerThan, OrEqualTo
dispatch = Dispatch(List=removeduplicatepts, DispatchPattern=smaller_than.OrEqualTo)  # -> ListA, ListB
vec = VectorXYZ(XComponent=Slider(17, range=-20..20), YComponent=Slider(20, range=-20..20), ZComponent=Slider(-100, range=-100..20))  # -> Vector, Length
pointload = Point(dispatch.ListB)
support = Point(dispatch.ListA)
entwine = Entwine(Branch00=explode, Branch03=support, Branch04=pointload, Branch05=vec.Vector, FlattenInputs=True)

# ----
# Model 0
number_slider_2 = Slider(-20, range=-20..20)
vec_2 = VectorXYZ(XComponent=number_slider_2, YComponent=0, ZComponent=0)  # -> Vector, Length
pointload_2 = Point([Point(0, 0, 10), Point(5, 0, 10), Point(0, 5, 5), Point(0, 5, 10), Point(0, 0, 5)])
support_2 = Point([Point(0, 0, 0), Point(5, 0, 0), Point(10, 0, 0), Point(15, 0, 0), Point(15, 5, 0), Point(10, 5, 0), Point(5, 5, 0), Point(0, 5, 0)])
vec_3 = VectorXYZ(XComponent=Slider(0, range=-20..20), YComponent=0, ZComponent=0)  # -> Vector, Length
vec_4 = VectorXYZ(XComponent=0, YComponent=Slider(11, range=-20..20), ZComponent=0)  # -> Vector, Length
beam = Curve([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])
shell_2 = Mesh([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])
truss = Curve([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])
cantiliver = Curve([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])
columns = Curve([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])
refine_2 = Refine(Mesh=shell_2, Level="2")
mesh_2 = Mesh(refine_2)
clean_2 = CombineClean(Meshes=mesh_2)
explode_2 = MeshExplode(Mesh=clean_2, Interpolate=False)  # -> flatten(Faces)
entwine_2 = Entwine(
    Branch00=explode_2,
    Branch01=beam,
    Branch02=truss,
    Branch03=support_2,
    Branch04=pointload_2,
    Branch05=vec_2.Vector,
    Branch06=columns,
    Branch07=vec_3.Vector,
    Branch08=cantiliver,
    Branch09=vec_4.Vector,
    FlattenInputs=True)

# ----
# Model 4
number_slider_3 = Slider(60, range=0..100)
construct_point = ConstructPoint(XCoordinate=0, YCoordinate=0, ZCoordinate=0)
construct_point_2 = ConstructPoint(XCoordinate=number_slider_3, YCoordinate=0, ZCoordinate=0)
unit_z = UnitZ(Factor=Slider(10, range=0..10))
line = Line(StartPoint=construct_point, EndPoint=construct_point_2)
move = Move(Geometry=line, Motion=unit_z)  # -> Geometry, Transform
panel = Panel(number_slider_3)
_2d_truss = _2DTruss(CurveA=line, CurveB=move.Geometry, Divisions=Slider(5, range=0..10), TrussToggle=0)  # -> PrimaryLines, BraceLines, VerticalLines, StructureNodes
pdecon_2 = Deconstruct(Point=_2d_truss.StructureNodes)  # -> XComponent, YComponent, ZComponent
pdecon_3 = Deconstruct(Point=_2d_truss.StructureNodes)  # -> XComponent, YComponent, ZComponent
equality = Equality(FirstNumber=pdecon_3.XComponent, SecondNumber=panel)  # -> Equality, Inequality
smaller = SmallerThan(FirstNumber=pdecon_2.XComponent, SecondNumber="0.1")  # -> SmallerThan, OrEqualTo
merge = Merge(Data1=_2d_truss.PrimaryLines, Data2=_2d_truss.BraceLines, Data3=_2d_truss.VerticalLines)
cull = CullPattern(List=_2d_truss.StructureNodes, CullPattern=equality.Equality)  # -> flatten(List)
cull_2 = CullPattern(List=_2d_truss.StructureNodes, CullPattern=smaller.SmallerThan)  # -> flatten(List)
vec_5 = VectorXYZ(XComponent=0, YComponent=0, ZComponent="-100")  # -> Vector, Length
pointload_3 = Point(cull)
support_3 = Point(cull_2)
beam_2 = Curve(merge)
entwine_3 = Entwine(Branch01=beam_2, Branch03=support_3, Branch04=pointload_3, Branch05=vec_5.Vector, FlattenInputs=True)

# ----
# Model 2
number_slider_4 = Slider(6, range=0..10)
vector_xyz = VectorXYZ(XComponent=0, YComponent=0, ZComponent=0)  # -> Vector, Length
vector_xyz_2 = VectorXYZ(XComponent=0, YComponent=0, ZComponent=number_slider_4)  # -> Vector, Length
move_2 = Move(Geometry=vector_xyz.Vector, Motion=vector_xyz_2.Vector)  # -> Geometry, Transform
line_2 = Line(StartPoint=vector_xyz.Vector, EndPoint=move_2.Geometry)
num = Number("10000")
pointload_4 = Point(move_2.Geometry)
vec_6 = VectorXYZ(XComponent=0, YComponent=Slider(6, range=-20..20), ZComponent=0)  # -> Vector, Length
pointload_5 = Point(move_2.Geometry)
support_4 = Point(vector_xyz.Vector)
vec_7 = VectorXYZ(XComponent=Slider(0, range=-20..20), YComponent=0, ZComponent=0)  # -> Vector, Length
beam_3 = Curve(line_2)
columns_2 = Curve(beam_3)
entwine_4 = Entwine(
    Branch01=beam_3,
    Branch03=support_4,
    Branch04=pointload_5,
    Branch05=vec_6.Vector,
    Branch06=columns_2,
    Branch07=vec_7.Vector,
    Branch010=pointload_4,
    Branch011=num,
    FlattenInputs=True)

# ---- group: Element
data = Data(0)
data_2 = Data(0)

# ---- group: Load
data_3 = Data(0)
data_4 = Data(0)

# ---- group: Cross-Section
data_5 = Data(0)
data_6 = Data(0)

# ---- group: Support
data_7 = Data(0)
data_8 = Data(0)

# ---- group: Constraint
data_9 = Data(0)
data_10 = Data(0)

# ---- group: Material
data_11 = Data(0)
data_12 = Data(0)

# ----
list = ValueList({"Building": 0, "Shell": 1, "Cantiliver": 2, "Brick": 3, "Truss": 4}, selected="Truss")
custom_preview = CustomPreview(Geometry=support_2, Material=ColourSwatch(SwatchColor=RGB(0, 0, 0)))

# ----
# UniaxialMaterial
# Elastic
file_path = FilePath("C:\GitHub\Alpaca4d\PythonScript\Pre-Processing\Material\uniAxialMaterial\ElasticUniaxialMaterial.py")
read_file = ReadFile(File=file_path, PerLineParse=False)
python = GhPythonScript(Code=read_file, MatName="S275", E="210000", G="80760", Rho="75", Fy="35")  # -> Out, ElasticMaterialWrapper
python_2 = GhPythonScript(x=python.ElasticMaterialWrapper)  # -> out, a
# ---------- python_2: Python ----------
a = x
# ---------- end python_2 ----------
panel_2 = Panel(python_2.a)

# ----
# UniaxialMaterial
# Elastic
panel_3 = Panel("210000")
python_3 = GhPythonScript(Code=read_file, MatName="S255", E=panel_3, G="80760", Rho="75", Fy="25")  # -> Out, ElasticMaterialWrapper
python_4 = GhPythonScript(x=python_3.ElasticMaterialWrapper)  # -> out, a; same code as python_2
panel_4 = Panel(python_4.a)

# ----
# nDMaterial
# ElasticIsotropic
file_path_2 = FilePath("C:\GitHub\Alpaca4d\PythonScript\Pre-Processing\Material\nDMaterial\ElasticIsotropic.py")
read_file_2 = ReadFile(File=file_path_2, PerLineParse=False)
python_5 = GhPythonScript(Code=read_file_2, MatName="S275", E="210000", G="80760", Rho="75", Fy="35")  # -> Out, ElasticMaterialWrapper

# ----
# Generic Cross Section
file_path_3 = FilePath("C:\GitHub\Alpaca4d\PythonScript\Pre-Processing\Section\GenericCrossSection.py")
read_file_3 = ReadFile(File=file_path_3, PerLineParse=False)
python_6 = GhPythonScript(
    Code=read_file_3,
    SectionName="Generic",
    Area="20",
    Ay="20",
    Az="20",
    Iyy="20",
    Izz="20",
    J="20",
    Material=python.ElasticMaterialWrapper)  # -> Out, GenericCrossSection

file_path_4 = FilePath("C:\GitHub\Alpaca4d\PythonScript\Pre-Processing\Load\BeamLoad.py")

# ----
# WIP
panel_5 = Panel("100")
random = Random(Range="20", Number=panel_5, Seed=2)
random_2 = Random(Range="20", Number=panel_5, Seed="3")
pt = ConstructPoint(XCoordinate=random, YCoordinate=random_2, ZCoordinate=0)
python_7 = GhPythonScript(Pos=pt, RigidDiaphragm=Toggle(True))  # -> Out, A

read_file_4 = ReadFile(File=file_path_4, PerLineParse=False)

# ----
# Circular CrossSection
file_path_5 = FilePath("C:\GitHub\Alpaca4d\PythonScript\Pre-Processing\Section\CircularCrossSection.py")
read_file_5 = ReadFile(File=file_path_5, PerLineParse=False)
python_8 = GhPythonScript(Code=read_file_5, SectionName="CHS", Diameter="300", Thickness="150", Material=python_3.ElasticMaterialWrapper)  # -> Out, CircleCrossSection

# ----
# Elastic Membrane Plate Section
file_path_6 = FilePath("C:\GitHub\Alpaca4d\PythonScript\Pre-Processing\Section\ElasticMembranePlateSection.py")
read_file_6 = ReadFile(File=file_path_6, PerLineParse=False)
python_9 = GhPythonScript(Code=read_file_6, SectionName="concreteSlab", Thickness="200", Material=python_5.ElasticMaterialWrapper)  # -> Out, PlateFiberSection

# ----
# Rectangular Cross Section
file_path_7 = FilePath("C:\GitHub\Alpaca4d\PythonScript\Pre-Processing\Section\RectangularCrossSection.py")
read_file_7 = ReadFile(File=file_path_7, PerLineParse=False)
python_10 = GhPythonScript(Code=read_file_7, SectionName="RHS", Base="300", Height="300", Material=python.ElasticMaterialWrapper)  # -> Out, RectangularCrossSection

# ----
# visualizeTimeDeformation per Time History
toggle = BooleanToggle(False)
python_11 = GhPythonScript(Reset=Button(), Run=toggle)  # -> out, b; inputs Reset: Boolean
# ---------- python_11: Python ----------
import Grasshopper as gh
import Rhino.Geometry as rg

def updateComponent(interval):
    
    """ Updates this component, similar to using a grasshopper timer """
    
    # Define callback action
    def callBack(e):
        ghenv.Component.ExpireSolution(False)
        
    # Get grasshopper document
    ghDoc = ghenv.Component.OnPingDocument()
    
    # Schedule this component to expire
    ghDoc.ScheduleSolution(interval,gh.Kernel.GH_Document.GH_ScheduleDelegate(callBack)) # Note that the first input here is how often to update the component (in milliseconds)


time = []
displacement = []

# text file with the displacement output as per ops.record()

with open(r"C:\Users\FORMAT\Desktop\New folder\DFree.out", 'r') as f:
    lines = f.readlines()
    for n, line in enumerate(lines):
        if (n % 10) == 0:
            line = line.strip().split(" ")
            time.append( line[0] )
            displacementTemp = line[1:]
            n = 6
            displacementTime = [displacementTemp[i:i + n] for i in range(0, len(displacementTemp), n)]
            displacement.append(displacementTime)


b = []

if "m" not in globals() or Reset:
    m = 0

if Run and not Reset:
    m += 1
    updateComponent(1)

for vector in displacement[m]:
    b.append( rg.Vector3d(float(vector[0]), float(vector[1]), float(vector[2]) ) )
# ---------- end python_11 ----------
panel_6 = Panel(python_11.b)
vec_8 = Vector(python_11.b)
multiplication = Multiplication(A=vec_8, B=Slider(34.04, range=-10..200))
move_3 = Move(Motion=multiplication)  # -> Geometry, Transform

# ----
# have a look
toggle_2 = BooleanToggle(False)
python_12 = GhPythonScript(Reset=Button(), Run=toggle_2)  # -> out, b; inputs Reset: Boolean
# ---------- python_12: Python ----------
import Grasshopper as gh
import Rhino.Geometry as rg

def updateComponent(interval):
    
    """ Updates this component, similar to using a grasshopper timer """
    
    # Define callback action
    def callBack(e):
        ghenv.Component.ExpireSolution(False)
        
    # Get grasshopper document
    ghDoc = ghenv.Component.OnPingDocument()
    
    # Schedule this component to expire
    ghDoc.ScheduleSolution(interval,gh.Kernel.GH_Document.GH_ScheduleDelegate(callBack)) # Note that the first input here is how often to update the component (in milliseconds)


time = []
displacement = []




b = []

if "m" not in globals() or Reset:
    m = 0

if Run and not Reset:
    m += 1
    print(m)
    updateComponent(1)

"""
for vector in displacement[m]:
    b.append( rg.Vector3d(float(vector[0]), float(vector[1]), float(vector[2]) ) )
"""
# ---------- end python_12 ----------
panel_7 = Panel(python_12.b)
vec_9 = Vector(python_12.b)
multiplication_2 = Multiplication(A=vec_9, B=Slider(34.04, range=-10..200))
move_4 = Move(Motion=multiplication_2)  # -> Geometry, Transform

file_path_8 = FilePath("C:\GitHub\Alpaca4d\PythonScript\Post-Processing\disassembleModel\disassembleModel.py")
path = FilePath("C:\GitHub\Alpaca4d\PythonScript\Analyses\LinearAnalyses\initializeAnalysis.py")
read_file_8 = ReadFile(File=file_path_8, PerLineParse=False)
# solver on folder Static Analyses 3ndf
path_2 = FilePath("C:\GitHub\Alpaca4d\PythonScript\Analyses\openSees_StaticSolver_3ndf\initializeAnalysis_3ndf.py")
# solver on folder Static Analyses
file = ReadFile(File=path, PerLineParse=False)
file_2 = ReadFile(File=path_2, PerLineParse=False)
file_path_9 = FilePath("C:\GitHub\Alpaca4d\PythonScript\Post-Processing\shellForceView\shellForceView.py")

# ---- group: tension Visualisation
# nel shellForce avremo la mesh del diagramma che visualizziamo
# magari in questo posso mettere anche gli element brick ( se hanno le forze )
list_2 = ValueList({"sigmaX": 0, "sigmaY": 1, "sigmaZ": 2, "tauXY": 3, "tauYZ": 4, "tauXZ": 5, "mx": 6, "my": 7}, selected="sigmaX")
python_13 = GhPythonScript(ViewForce=list_2)

# ----
read_file_9 = ReadFile(File=file_path_9, PerLineParse=False)

# ----
# Numerical Ouput
number_slider_5 = Slider(10, range=0..10)
file_path_10 = FilePath("C:\GitHub\Alpaca4d\PythonScript\Post-Processing\beamDisp\beamDisp.py")
file_path_11 = FilePath("C:\GitHub\Alpaca4d\PythonScript\Post-Processing\shellDisp\shellDisp.py")
file_path_12 = FilePath("C:\GitHub\Alpaca4d\PythonScript\Post-Processing\nodalDisp\nodalDisp.py")
file_path_13 = FilePath("C:\GitHub\Alpaca4d\PythonScript\Post-Processing\brickDisp\brickDisp.py")
read_file_10 = ReadFile(File=file_path_10, PerLineParse=False)
read_file_11 = ReadFile(File=file_path_11, PerLineParse=False)
read_file_12 = ReadFile(File=file_path_12, PerLineParse=False)
read_file_13 = ReadFile(File=file_path_13, PerLineParse=False)

file_path_14 = FilePath("C:\GitHub\Alpaca4d\PythonScript\Post-Processing\defModelView\defModelView.py")
read_file_14 = ReadFile(File=file_path_14, PerLineParse=False)
path_3 = FilePath("C:\GitHub\Alpaca4d\PythonScript\Post-Processing\viewGroundAccAnalyses\viewGroundAccAnalyses.py")
file_3 = ReadFile(File=path_3, PerLineParse=False)

# ---- group: Legend Display
number_slider_6 = Slider(10, range=0..10)
number_slider_7 = Slider(35, range=0..1000)
number_slider_8 = Slider(655, range=0..1000)

number_slider_9 = Slider(10, range=0..10)
number_slider_10 = Slider(35, range=0..1000)
number_slider_11 = Slider(655, range=0..1000)

number_slider_12 = Slider(10, range=0..10)
number_slider_13 = Slider(35, range=0..1000)
number_slider_14 = Slider(655, range=0..1000)

# ----
# Model 3
panel_8 = Panel("40")
rectangle = Rectangle(Plane=PlaneXY(0, 0, 0), XSize=panel_8, YSize="10", Radius=0)  # -> Rectangle, Length
mesh_surface = MeshSurface(
    Surface=rectangle.Rectangle,
    UCount=Slider(10, range=0..10),
    VCount=Slider(3, range=0..10),
    Overhang=True,
    Equalize=False)
weaverbird_s_offset_mesh = WeaverbirdsOffsetMesh(MeshCurves=mesh_surface, Distance=Slider(1, range=0..10), OffsetType=0)
entwine_5 = Entwine(Branch00=mesh_surface, Branch01=weaverbird_s_offset_mesh, FlattenInputs=True)  # -> flatten(Result)
subtraction = Subtraction(A=panel_8, B="1")
vec_10 = VectorXYZ(XComponent=0, YComponent=0, ZComponent="-100")  # -> Vector, Length

# ---- group: brith to loft mesh
ghpython_script = GhPythonScript(MeshSeries=entwine_5, color=ColourSwatch(SwatchColor=RGB(4, 0, 255)))  # -> out, simplify(flatten(Brick)); inputs MeshSeries: list of Mesh
# ---------- ghpython_script: Python ----------
import Rhino.Geometry as rg

def MeshToShell(Mesh):
    
    Mesh.Unweld(0, True)
    mesh = Mesh.ExplodeAtUnweldedEdges()
    newMesh = []
    elementType = []
    for explodedMesh in mesh:
        newMesh.append(explodedMesh)
    return newMesh 

def brick( MeshList, color ):
    meshExpl = []
    Vertix = []
    elementType = []
    solid = []
    
    for Mesh in MeshList:
        shellWrapper = MeshToShell(Mesh)
        meshExpl.append( shellWrapper )
    for index1 in range(0, len(MeshList)-1):
        for index2 in range(0, len(meshExpl[0])):
            if meshExpl[ index1 ][ index2 ].Vertices.Count == 4:
                
                elementType.append("stdBrick")
                vertix1 = meshExpl[ index1 ][ index2 ].Vertices[0]
                vertix2 = meshExpl[ index1 ][ index2 ].Vertices[1]
                vertix3 = meshExpl[ index1 ][ index2 ].Vertices[2]
                vertix4 = meshExpl[ index1 ][ index2 ].Vertices[3]
                vertix5 = meshExpl[index1 + 1 ][ index2].Vertices[0]
                vertix6 = meshExpl[index1 + 1 ][ index2].Vertices[1]
                vertix7 = meshExpl[index1 + 1 ][ index2].Vertices[2]
                vertix8 = meshExpl[index1 + 1 ][ index2].Vertices[3]
                
                vertix = [ vertix1, vertix2, vertix3, vertix4,
                vertix5, vertix6, vertix7, vertix8 ]
                
                ele = rg.Mesh()
                
                ele.Vertices.Add( vertix1 ) # 0 
                ele.Vertices.Add( vertix2 ) # 1
                ele.Vertices.Add( vertix3 ) # 2
                ele.Vertices.Add( vertix4 ) # 3
                ele.Vertices.Add( vertix5 ) # 4
                ele.Vertices.Add( vertix6 ) # 5
                ele.Vertices.Add( vertix7 ) # 6
                ele.Vertices.Add( vertix8 ) # 7
                
                ele.VertexColors.Add(color)
                ele.VertexColors.Add(color)
                ele.VertexColors.Add(color)
                ele.VertexColors.Add(color)
                ele.VertexColors.Add(color)
                ele.VertexColors.Add(color)
                ele.VertexColors.Add(color)
                ele.VertexColors.Add(color)
    
                
                ele.Faces.AddFace(0, 1, 2, 3) # 0
                ele.Faces.AddFace(4, 5, 6, 7) # 1
                ele.Faces.AddFace(0, 1, 5, 4) # 2
                ele.Faces.AddFace(3, 2, 6, 7) # 3
                ele.Faces.AddFace(1, 5, 6, 2) # 4
                ele.Faces.AddFace(0, 4, 7, 3) # 5
                
            else :
                elementType.append(["FourNodeTetrahedron"]*3)
                
                if meshExpl[ index1 ][ index2 ].Vertices[0] == meshExpl[index1 + 1 ][ index2].Vertices[0] :
                    vertix1 = meshExpl[ index1 ][ index2 ].Vertices[0]
                    vertix2 = meshExpl[ index1 ][ index2 ].Vertices[1]
                    vertix3 = meshExpl[ index1 ][ index2 ].Vertices[2]
                    vertix4 = meshExpl[index1 + 1 ][ index2].Vertices[1]
                    vertix5 = meshExpl[index1 + 1 ][ index2].Vertices[2]
                    
                    vertixEle1 = [ vertix1, vertix2, vertix3, vertix4 ]
                    vertixEle2 = [ vertix1, vertix2, vertix3, vertix2 ]
                    
                    ele1 = rg.Mesh() # Tetrahedron 1
                    ele2 = rg.Mesh() # Tetrahedron 2
                    
                    ele1.Vertices.Add( vertix1 ) # 0 
                    ele1.Vertices.Add( vertix2 ) # 1
                    ele1.Vertices.Add( vertix3 ) # 2 
                    ele1.Vertices.Add( vertix4 ) # 3 
                    
                    ele1.VertexColors.Add(color)
                    ele1.VertexColors.Add(color)
                    ele1.VertexColors.Add(color)
                    ele1.VertexColors.Add(color)
                    
                    ele2.Vertices.Add( vertix1 ) # 0 
                    ele2.Vertices.Add( vertix2 ) # 1 
                    ele2.Vertices.Add( vertix3 ) # 2 
                    ele2.Vertices.Add( vertix2 ) # 3
    
                    ele2.VertexColors.Add(color)
                    ele2.VertexColors.Add(color)
                    ele2.VertexColors.Add(color)
                    ele2.VertexColors.Add(color)
                    
                    ele1.Faces.AddFace(0, 1, 4 ) # 0
                    ele1.Faces.AddFace(0, 1, 3 ) # 1
                    ele1.Faces.AddFace(0, 4, 3 ) # 2
                    ele1.Faces.AddFace(1, 3, 4 ) # 3
                    
                    ele2.Faces.AddFace(0, 1, 3 ) # 0
                    ele2.Faces.AddFace(0, 1, 2 ) # 1
                    ele2.Faces.AddFace(1, 2, 3 ) # 2
                    ele2.Faces.AddFace(0, 2, 3 ) # 3
                    
                    ele = [ ele1, ele2 ]
                    
                else :
                
                    vertix1 = meshExpl[ index1 ][ index2 ].Vertices[0]
                    vertix2 = meshExpl[ index1 ][ index2 ].Vertices[1]
                    vertix3 = meshExpl[ index1 ][ index2 ].Vertices[2]
                    vertix4 = meshExpl[index1 + 1 ][ index2].Vertices[0]
                    vertix5 = meshExpl[index1 + 1 ][ index2].Vertices[1]
                    vertix6 = meshExpl[index1 + 1 ][ index2].Vertices[2]
                    
                    vertixEle1 = [ vertix1, vertix2, vertix3, vertix6 ]
                    vertixEle2 = [ vertix4, vertix5, vertix6, vertix1 ]
                    vertixEle3 = [ vertix5, vertix6, vertix2, vertix1 ]
                    
                    vertix = [ vertixEle1, vertixEle2, vertixEle3 ]
                    
                    ele1 = rg.Mesh() # Tetrahedron 1
                    ele2 = rg.Mesh() # Tetrahedron 2
                    ele3 = rg.Mesh() # Tetrahedron 3
                    
                    ele1.Vertices.Add( vertix1 ) # 0 
                    ele1.Vertices.Add( vertix2 ) # 1
                    ele1.Vertices.Add( vertix3 ) # 2 
                    ele1.Vertices.Add( vertix6 ) # 3 
                    
                    ele1.VertexColors.Add(color)
                    ele1.VertexColors.Add(color)
                    ele1.VertexColors.Add(color)
                    ele1.VertexColors.Add(color)
                    
                    ele2.Vertices.Add( vertix4 ) # 0 
                    ele2.Vertices.Add( vertix5 ) # 1 
                    ele2.Vertices.Add( vertix6 ) # 2 
                    ele2.Vertices.Add( vertix1 ) # 3
    
                    ele2.VertexColors.Add(color)
                    ele2.VertexColors.Add(color)
                    ele2.VertexColors.Add(color)
                    ele2.VertexColors.Add(color)
                    
                    ele3.Vertices.Add( vertix5 ) # 0 
                    ele3.Vertices.Add( vertix6 ) # 1 
                    ele3.Vertices.Add( vertix2 ) # 2 
                    ele3.Vertices.Add( vertix1 ) # 3
                    
                    ele3.VertexColors.Add(color)
                    ele3.VertexColors.Add(color)
                    ele3.VertexColors.Add(color)
                    ele3.VertexColors.Add(color)
                    
                    ele1.Faces.AddFace(0, 1, 2 ) # 0
                    ele1.Faces.AddFace(0, 3, 1 ) # 1
                    ele1.Faces.AddFace(0, 3, 2 ) # 2
                    ele1.Faces.AddFace(1, 3, 2 ) # 3
                    
                    ele2.Faces.AddFace(0, 1, 2 ) # 0
                    ele2.Faces.AddFace(0, 3, 1 ) # 1
                    ele2.Faces.AddFace(0, 3, 2 ) # 2
                    ele2.Faces.AddFace(1, 3, 2 ) # 3
                    
                    ele3.Faces.AddFace(0, 1, 2 ) # 0
                    ele3.Faces.AddFace(0, 3, 1 ) # 1
                    ele3.Faces.AddFace(0, 3, 2 ) # 2
                    ele3.Faces.AddFace(1, 3, 2 ) # 3
                    
                    ele = [ ele1, ele2, ele3 ]
            
            solid.append(ele)
            Vertix.append( vertix )
    return solid, elementType

Brick, type = brick( MeshSeries, color )
# ---------- end ghpython_script ----------

# ----
deconstruct_mesh_2 = DeconstructMesh(Mesh=ghpython_script.Brick)  # -> Vertices, Faces, Colours, Normals
removeduplicatepts_2 = RemoveDuplicatePts(Points=flatten(deconstruct_mesh_2.Vertices), Tolerance=0.01)
ghpython_script_2 = GhPythonScript(x=ghpython_script.Brick)  # -> out, flatten(a); same code as python_2
pdecon_4 = Deconstruct(Point=removeduplicatepts_2)  # -> XComponent, YComponent, ZComponent
smaller_2 = SmallerThan(FirstNumber=pdecon_4.XComponent, SecondNumber="0.1")  # -> SmallerThan, OrEqualTo
larger_than = LargerThan(FirstNumber=pdecon_4.XComponent, SecondNumber=subtraction)  # -> LargerThan, OrEqualTo
cull_3 = CullPattern(List=removeduplicatepts_2, CullPattern=smaller_2.SmallerThan)  # -> graft(List)
cull_4 = CullPattern(List=removeduplicatepts_2, CullPattern=larger_than.LargerThan)  # -> graft(List)
point = Point(cull_3)
point_2 = Point(cull_4)
pointload_6 = Point(point_2)
support_5 = Point(point)
entwine_6 = Entwine(Branch03=support_5, Branch04=pointload_6, Branch05=vec_10.Vector, Branch012=ghpython_script.Brick, FlattenInputs=True)

stream_filter = StreamFilter(Gate=list, Stream0=entwine_2, Stream1=entwine, Stream2=entwine_4, Stream3=entwine_6, Stream4=entwine_3)
explode_tree = ExplodeTree(Data=stream_filter)  # -> Branch0, Branch1, Branch2, Branch3, Branch4, Branch5, Branch6, Branch7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

pointload_7 = Point(explode_tree.Branch4)
vector = Data(explode_tree.Branch5)

support_6 = Point(explode_tree.Branch3)
truss_2 = Curve(explode_tree.Branch2)

data_13 = Data(explode_tree.Branch6)
vector_2 = Data(explode_tree.Branch7)

data_14 = Data(explode_tree.Branch8)
vector_3 = Data(explode_tree.Branch9)

shell_3 = Mesh(explode_tree.Branch0)
beam_4 = Curve(explode_tree.Branch1)

data_15 = Data(explode_tree.Branch10)
mass = Data(explode_tree.Branch11)

brick = Data(explode_tree.Branch12)

# ----
# Support
file_path_15 = FilePath("C:\GitHub\Alpaca4d\PythonScript\Pre-Processing\Element\Support\Support.py")
toggle_3 = BooleanToggle(True)
read_file_15 = ReadFile(File=file_path_15, PerLineParse=False)
point_3 = Point(support_6)
python_14 = GhPythonScript(Code=read_file_15, Pos=graft(point_3), Tx=toggle_3, Ty=Toggle(True), Tz=toggle_3, Rx=toggle_3, Ry=toggle_3, Rz=toggle_3)  # -> Out, flatten(SupportWrapper)
python_15 = GhPythonScript(x=python_14.SupportWrapper)  # -> out, a; same code as python_2
panel_9 = Panel(python_15.a)

# ----
# Linear Load
value_list = ValueList({"LocalAxis": 0, "GlobalAxis": 1}, selected="GlobalAxis")
vector_4 = Vector(vector_2)
crv = Curve(data_13)
python_16 = GhPythonScript(Code=read_file_4, Force=vector_4, Element=crv, Orientation=value_list)  # -> Out, flatten(BeamUniformLoad)

# ----
# Linear Load
value_list_2 = ValueList({"LocalAxis": 0, "GlobalAxis": 1}, selected="GlobalAxis")
vector_5 = Vector(vector_3)
crv_2 = Curve(data_14)
python_17 = GhPythonScript(Code=read_file_4, Force=vector_5, Element=crv_2, Orientation=value_list_2)  # -> Out, flatten(BeamUniformLoad)

# ----
# Point Load
file_path_16 = FilePath("C:\GitHub\Alpaca4d\PythonScript\Pre-Processing\Load\PointLoad.py")
read_file_16 = ReadFile(File=file_path_16, PerLineParse=False)
vector_6 = Vector(expr("x*0", Vector(2.518385542, -6.656153768, 0)))
vector_7 = Vector(vector)
point_4 = Point(pointload_7)
python_18 = GhPythonScript(Code=read_file_16, Force=vector_7, Moment=vector_6, Pos=point_4)  # -> Out, flatten(LoadWrapper)

# ----
# MassLoad
num_2 = Number(mass)
path_4 = FilePath("C:\GitHub\Alpaca4d\PythonScript\Pre-Processing\Load\MassLoad.py")
pt_2 = Point(data_15)
file_4 = ReadFile(File=path_4, PerLineParse=False)
python_19 = GhPythonScript(Code=file_4, NodalMassTranslation=num_2, Pos=pt_2)  # -> Out, flatten(Mass)

# ----
# meshToShell
mesh_3 = Mesh(shell_3)
file_path_17 = FilePath("C:\GitHub\Alpaca4d\PythonScript\Pre-Processing\Element\MeshToShell\MeshToShell.py")
read_file_17 = ReadFile(File=file_path_17, PerLineParse=False)
python_20 = GhPythonScript(
    Code=read_file_17,
    Mesh=mesh_3,
    Colour=ColourSwatch(SwatchColor=RGB(0, 72, 255)),
    CrossSection=python_9.PlateFiberSection)  # -> Out, flatten(ShellWrapper)

# ----
# LineToBeam
file_path_18 = FilePath("C:\GitHub\Alpaca4d\PythonScript\Pre-Processing\Element\LineToBeam\LineToBeam.py")
read_file_18 = ReadFile(File=file_path_18, PerLineParse=False)
list_3 = ValueList({"Truss": 0, "Beam": 1}, selected="Beam")
crv_3 = Curve(beam_4)
python_21 = GhPythonScript(
    Code=read_file_18,
    Line=crv_3,
    Colour=ColourSwatch(SwatchColor=RGB(34, 255, 0)),
    CrossSection=python_8.CircleCrossSection,
    OrientSection="0",
    BeamType=list_3)  # -> Out, flatten(BeamWrapper)

crv_4 = Curve(truss_2)

data_16 = Data([python_16.BeamUniformLoad, python_17.BeamUniformLoad, python_18.LoadWrapper])

# ----
# Solid
swatch = ColourSwatch(SwatchColor=RGB(0, 72, 255))
python_22 = GhPythonScript(solid=brick, Colour=swatch, material=python_5.ElasticMaterialWrapper)  # -> out, flatten(SolidWrapper); inputs solid: Mesh
# ---------- python_22: Python ----------
import Rhino.Geometry as rg

def Solid( Mesh, Colour, material):
    
    #Mesh.Unweld(0, True)
    
    #elementType = []
    if Mesh.Vertices.Count == 8:
        elementType = "bbarBrick"
    else:
        elementType = "FourNodeTetrahedron"
    newMesh = Mesh
    
    Material = material
    colour = Colour
    return[ [ newMesh , elementType, Material, colour ] ]

SolidWrapper = Solid( solid, Colour, material )
# ---------- end python_22 ----------

# ----
# LineToTruss
list_4 = ValueList({"Truss": 0, "Beam": 1}, selected="Truss")
python_23 = GhPythonScript(
    Code=read_file_18,
    Line=crv_4,
    Colour=ColourSwatch(SwatchColor=RGB(255, 200, 0)),
    CrossSection=python_8.CircleCrossSection,
    OrientSection="0",
    BeamType=list_4)  # -> Out, flatten(BeamWrapper)

item = ListItem(List=python_22.SolidWrapper, Index=0, Wrap=True)  # -> Item, Item1
python_24 = GhPythonScript(x=item.Item)  # -> out, simplify(a); same code as python_2
python_25 = GhPythonScript(x=python_24.a)  # -> out, simplify(a); same code as python_2
python_26 = GhPythonScript(x=python_25.a)  # -> out, simplify(a); same code as python_2
merge_2 = Merge(Data1=python_20.ShellWrapper, Data2=python_21.BeamWrapper, Data3=python_23.BeamWrapper, Data4=python_22.SolidWrapper)
panel_10 = Panel(python_26.a)

# ----
# Assemble
file_path_19 = FilePath("C:\GitHub\Alpaca4d\PythonScript\Pre-Processing\Assemble\Assemble.py")
read_file_19 = ReadFile(File=file_path_19, PerLineParse=False)
python_27 = GhPythonScript(
    Code=read_file_19,
    Element=flatten(merge_2),
    Support=flatten(python_14.SupportWrapper),
    Load=flatten(data_16),
    Mass=flatten(python_19.Mass))  # -> Out, OpenSeesModel

# ----
# modelView
# da fare a cluster
file_path_20 = FilePath("C:\GitHub\Alpaca4d\PythonScript\Post-Processing\modelView\modelView.py")
read_file_20 = ReadFile(File=file_path_20, PerLineParse=False)
python_28 = GhPythonScript(
    Code=read_file_20,
    OpenSeesModel=python_27.OpenSeesModel,
    ModelExstrud=Toggle(False),
    Load=Toggle(True),
    Support=Toggle(False),
    LocalAxes=Toggle(False),
    NodeTag=Toggle(False),
    ElementTag=Toggle(False))  # -> ModelView, LineModel, ForceDisplay, Support, LocalAxis, TagNode, TagEle
modelview = ModelView(python_28.ModelView)
explode_tree_2 = ExplodeTree(Data=python_28.LocalAxis)  # -> Branch0, Branch1, Branch2, Branch3
explode_tree_3 = ExplodeTree(Data=python_28.LineModel)  # -> Branch0, Branch1
explode_tree_4 = ExplodeTree(Data=simplify(python_28.TagNode))  # -> Branch0, Branch1
explode_tree_5 = ExplodeTree(Data=simplify(python_28.TagEle))  # -> Branch0, Branch1
explode_tree_6 = ExplodeTree(Data=python_28.ForceDisplay)  # -> Branch0, Branch1
curve_direction = GhPythonScript(Crv=explode_tree_3.Branch0, Thickness=Slider(3, range=0..10), RGB=explode_tree_3.Branch1)  # -> out; inputs Crv: list of Curve, RGB: list of Color
# ---------- curve_direction: Python ----------
from ghpythonlib.componentbase import executingcomponent as component
import Grasshopper, GhPython
import System
import Rhino as rh
import rhinoscriptsyntax as rs
import Rhino.Geometry as rg


class CurveColor(component):

    def RunScript(self,Crv,Thickness,RGB):
        self.C = Crv
        self.RGB = RGB
        self.t = Thickness
        if not self.C: return
            
    def DrawViewportWires(self,arg):
        if not  self.C: return
        for curve, color in zip( self.C, self.RGB ):
            arg.Display.DrawCurve(curve, color,self.t)
# ---------- end curve_direction ----------
custom_preview_2 = CustomPreview(Geometry=python_28.Support, Material=ColourSwatch(SwatchColor=RGB(164, 252, 0)))
vector_display_ex = VectorDisplayEx(Point=explode_tree_6.Branch0, Vector=explode_tree_6.Branch1, Colour=ColourSwatch(SwatchColor=RGB(176, 32, 32)), Width=2)
vector_display_ex_2 = VectorDisplayEx(Point=explode_tree_2.Branch0, Vector=explode_tree_2.Branch1, Colour=ColourSwatch(SwatchColor=RGB(252, 0, 0)), Width=2)
vector_display_ex_3 = VectorDisplayEx(Point=explode_tree_2.Branch0, Vector=explode_tree_2.Branch2, Colour=ColourSwatch(SwatchColor=RGB(0, 245, 53)), Width=2)
vector_display_ex_4 = VectorDisplayEx(Point=explode_tree_2.Branch0, Vector=explode_tree_2.Branch3, Colour=ColourSwatch(SwatchColor=RGB(0, 55, 255)), Width=2)
tag = TextTag(Location=explode_tree_4.Branch0, Text=explode_tree_4.Branch1, Colour=ColourSwatch(SwatchColor=RGB(255, 0, 0)))
tag_2 = TextTag(Location=explode_tree_5.Branch0, Text=explode_tree_5.Branch1, Colour=ColourSwatch(SwatchColor=RGB(25, 0, 255)))

# ----
# EarthQuake Analyses
path_5 = FilePath("C:\GitHub\Alpaca4d\PythonScript\Analyses\EarthQuakeAnalysis\BM68elc.acc")
path_6 = FilePath("C:\GitHub\Alpaca4d\PythonScript\Analyses\EarthQuakeAnalysis\initializeEarthQuakeAnalysis.py")
list_5 = ValueList({"x": 1, "y": 2, "z": 3}, selected="x")
file_5 = ReadFile(File=path_6, PerLineParse=False)
analyze = GhPythonScript(
    Code=file_5,
    OpenSeesModel=python_27.OpenSeesModel,
    TmaxAnalyses="50",
    GroundMotionDirection=list_5,
    GroundMotionFile=path_5,
    GroundMotionTimeStep="0.01",
    GroundMotionfactor="100",
    Damping=0.02,
    NewmarkGamma=0.5,
    NewmarkBeta=0.25)  # -> Out, OpenSeesOutputWrapper, MaxDisplacement, MinDisplacement; disabled

file_6 = ReadFile(File=path_5, PerLineParse=False)
split = TextSplit(Text=file_6, Separators=" ")
division = Division(A=split, B="1")
clean_3 = CleanTree(RemoveNulls=True, RemoveInvalid=True, RemoveEmpty=invert(False), Tree=division)
graph = QuickGraph(clean_3, SortOrder=0)
lng = ListLength(List=clean_3)
multiplication_3 = Multiplication(A=lng, B="0.01")
earthquake_file_seconds = Panel(multiplication_3)

# ----
# Modal Analyses
path_7 = FilePath("C:\GitHub\Alpaca4d\PythonScript\Analyses\DynamicAnalysis\initializeModalAnalyses.py")
file_7 = ReadFile(File=path_7, PerLineParse=False)
analyze_2 = GhPythonScript(Code=file_7, OpenSeesModel=python_27.OpenSeesModel, NumEigenvalues="3")  # -> Out, OpenSeesOutputWrapper, Frequency, Period; disabled
panel_11 = Panel(analyze_2.Frequency)

# ---- group: disassemble Model
python_29 = GhPythonScript(Code=read_file_8, OpenSeesModel=python_27.OpenSeesModel)  # -> Out, ModelView, ModelViewExtruded, Points, Support, Load, Material, Section

# ----
analyze_3 = GhPythonScript(Code=file, OpenSeesModel=python_27.OpenSeesModel)  # -> Out, OpenSeesOutputWrapper; disabled
analyze_4 = GhPythonScript(Code=file_2, OpenSeesModel=python_27.OpenSeesModel)  # -> Out, OpenSeesOutputWrapper
panel_12 = Panel(analyze.MaxDisplacement)
panel_13 = Panel(analyze.MinDisplacement)

# ---- group: Cds Visualisation
number_slider_15 = Slider(0.184, range=0.001..10)
file_path_21 = FilePath("C:\GitHub\Alpaca4d\PythonScript\Post-Processing\cdsView\cdsView.py")
read_file_21 = ReadFile(File=file_path_21, PerLineParse=False)
list_6 = ValueList({"N": 0, "V1": 1, "V2": 2, "M2": 3, "M1": 4, "Mt": 5}, selected="N")
python_30 = GhPythonScript(Code=read_file_21, OpenSeesOutputWrapper=analyze_3.OpenSeesOutputWrapper, Cds=list_6)

# ----
merge_3 = Merge(Data1=analyze_3.OpenSeesOutputWrapper, Data2=analyze_4.OpenSeesOutputWrapper)  # -> flatten(Result)

# ---- group: Beam Forces
file_path_22 = FilePath("C:\GitHub\Alpaca4d\PythonScript\Post-Processing\beamForces\beamForces.py")
read_file_22 = ReadFile(File=file_path_22, PerLineParse=False)
python_31 = GhPythonScript(Code=read_file_22, OpenSeesOutputWrapper=analyze_3.OpenSeesOutputWrapper, NumberResults=Slider(10, range=0..10))  # -> Out, TagElement, N, V1, V2, Mt, M1, M2
panel_14 = Panel(python_31.TagElement)

# ---- group: Reaction Forces
file_path_23 = FilePath("C:\GitHub\Alpaca4d\PythonScript\Post-Processing\reaction\reaction.py")
read_file_23 = ReadFile(File=file_path_23, PerLineParse=False)
# Force component
python_32 = GhPythonScript(
    Code=read_file_23,
    OpenSeesOutputWrapper=analyze_3.OpenSeesOutputWrapper,
    ReactionMomentsView=Toggle(False),
    ReactionForcesView=Toggle(True))  # -> Out, TagPoints, ReactionForces, ReactionMoments, View
tagpoints = TagPoints(python_32.TagPoints)
reactionforces = ReactionForces(python_32.ReactionForces)
reactionmoments = ReactionMoments(python_32.ReactionMoments)
explode_tree_7 = ExplodeTree(Data=python_32.View)  # -> Branch0, Branch1, Branch2, Branch3
vector_display = VectorDisplay(Anchor=explode_tree_7.Branch0, Vector=[explode_tree_7.Branch1, explode_tree_7.Branch2, explode_tree_7.Branch3])

# ---- group: shell Forces
file_path_24 = FilePath("C:\GitHub\Alpaca4d\PythonScript\Post-Processing\shellForces\shellForces.py")
read_file_24 = ReadFile(File=file_path_24, PerLineParse=False)
python_33 = GhPythonScript(Code=read_file_24, OpenSeesOutputWrapper=analyze_3.OpenSeesOutputWrapper)  # -> Out, TagElement, Fx, Fy, Fz, Mx, My, Mz
panel_15 = Panel(python_33.Fx)

# ---- group: nD Force Visualisation
list_7 = ValueList({"Fx": 0, "Fy": 1, "Fz": 2, "Mx": 3, "My": 4, "Mz": 5}, selected="Mx")
python_34 = GhPythonScript(Code=read_file_9, OpenSeesOutputWrapper=analyze_3.OpenSeesOutputWrapper, ViewForce=list_7)  # -> ModelForce, ForceValue

# ----
# deformedModelView
number_slider_16 = Slider(10, range=0..10000)
list_8 = ValueList({"tx": 0, "ty": 1, "tz": 2}, selected="tz")
python_35 = GhPythonScript(Code=read_file_14, OpenSeesOutputWrapper=merge_3, Direction=list_8, Scale=number_slider_16, ModelExstrud=Toggle(True))  # -> Out, ModelDisp, ModelCurve, Max_min
modeldisp = ModelDisp(python_35.ModelDisp)
max_min = Max_min(python_35.Max_min)
explode_tree_8 = ExplodeTree(Data=python_35.ModelCurve)  # -> Branch0, Branch1, Branch2
list_item = ListItem(List=python_35.Max_min, Index=0, Wrap=True)  # -> Item, Item1
construct_domain = ConstructDomain(DomainStart=list_item.Item1, DomainEnd=list_item.Item)
divide_curve = DivideCurve(Curve=explode_tree_8.Branch0, Count=explode_tree_8.Branch1, Kinks=False)  # -> Points, Tangents, simplify(Parameters)
dedomain = DeconstructDomain(Domain=construct_domain)  # -> Start, End
shatter = Shatter(Curve=graft(explode_tree_8.Branch0), Parameters=divide_curve.Parameters)  # -> simplify(Segments)
ghpython_script_3 = GhPythonScript(max=dedomain.End, min=dedomain.Start)  # -> out, color, tag, domain
# ---------- ghpython_script_3: Python ----------
import Rhino.Geometry as rg
import ghpythonlib.components as ghcomp
import math as mt
import ghpythonlib.treehelpers as th # per data tree
import Grasshopper
#import System as sy #DV
import sys
import rhinoscriptsyntax as rs

'''
ghFilePath = ghenv.LocalScope.ghdoc.Path
ghFileName = ghenv.LocalScope.ghdoc.Name
folderNameLength = len(ghFilePath)-len(ghFileName)-2 #have to remove '.gh'
ghFolderPath = ghFilePath[0:folderNameLength]

outputPath = ghFolderPath + 'assembleData'
wrapperFile = ghFolderPath + 'assembleData\\openSeesModel.txt'

userObjectFolder = Grasshopper.Folders.DefaultUserObjectFolder
fileName = userObjectFolder + 'Alpaca'
'''
fileName = r'C:\GitHub\Alpaca4d\PythonScript\function'
sys.path.append(fileName)

def gradientJet2(value, valueMax, valueMin):

    listcolo = [ rs.CreateColor( 0, 0, 102 ),
                rs.CreateColor( 0, 0, 255 ),
                rs.CreateColor( 0, 64, 255 ),
                rs.CreateColor( 0, 128, 255 ),
                rs.CreateColor( 0, 191, 255 ),
                rs.CreateColor( 0, 255, 255 ),
                rs.CreateColor( 0, 255, 191 ),
                rs.CreateColor( 0, 255, 128 ),
                rs.CreateColor( 0, 255, 64 ),
                rs.CreateColor( 0, 255, 0 ),
                rs.CreateColor( 64, 255, 0 ),
                rs.CreateColor( 128, 255, 0 ),
                rs.CreateColor( 191, 255, 0 ),
                rs.CreateColor( 255, 255, 0 ),
                rs.CreateColor( 255, 191, 0 ),
                rs.CreateColor( 255, 128, 0 ),
                rs.CreateColor( 255, 64, 0 ),
                rs.CreateColor( 255, 0, 0 ),
                rs.CreateColor( 230, 0, 0 ),
                rs.CreateColor( 204, 0, 0 )]

    #domain = linspace( valueMin,  valueMax, len( listcolo ) )
    n = len( listcolo )
    diff = (float(valueMax) - valueMin)/( n - 1 )
    domain = [diff * i + valueMin  for i in range(n)]
    return [ listcolo, domain ]


colorList = gradientJet2( value, max, min )
color = colorList[0]  #.reverse()
color.reverse()
tag = []
tag.append( str(round(colorList[1][0],2) ) )
for i in range(1,len(colorList[1])):
    tag.append( str(round(colorList[1][i-1],2)) + '< valor < ' + str(round(colorList[1][i],2)) )
domain = colorList[1]
tag.reverse()
# ---------- end ghpython_script_3 ----------
curve_direction_2 = GhPythonScript(Crv=flatten(shatter), Thickness=Slider(3, range=0..10), RGB=explode_tree_8.Branch2)  # -> out; inputs Crv: list of Curve, RGB: list of Color; same code as curve_direction
lng_2 = ListLength(List=ghpython_script_3.domain)
planesrf = PlaneSurface(Plane=PlaneXY(0, 0, 0), XSize=Slider(40, range=0..100), YSize=Slider(2, range=0..10))
divide = DivideDomain²(Domain=planesrf, UCount=lng_2, VCount=1)
subsrf = Isotrim(Surface=planesrf, Domain=divide)
mcol = MeshColours(Mesh=graft(subsrf), Colours=graft(ghpython_script_3.color))
mjoin = MeshJoin(Meshes=flatten(mcol))
pt_3 = ConstructPoint(XCoordinate=number_slider_8, YCoordinate=number_slider_7, ZCoordinate=0)
M = Mesh(mjoin)
render_mesh_to_screen = RenderMeshToScreen(Mesh=mjoin, Location=pt_3, ScaleFactor=number_slider_6, Depth=0.95, Fixed=True, m_scWithvp=False)

# ----
# we can skip some data point. We don't need to read all of them. This can help to make it faster.
# 
# OR
# 
# We can read ALL the files and show only some output.
number_of_line_to_skip = Slider(20, range=1..100)
list_9 = ValueList({"tx": 0, "ty": 1, "tz": 2}, selected="ty")
ghpython_script_4 = GhPythonScript(
    Code=file_3,
    OpenSeesOutputWrapper=analyze.OpenSeesOutputWrapper,
    Speed=number_of_line_to_skip,
    Animate=Toggle(True),
    Reset=Button(),
    Scale=Slider(25, range=0..1000),
    Direction=list_9,
    ModelExstrud=Toggle(True))  # -> Out, ModelDisp, ModelCurve, Max_min, Disp; disabled
list_item_2 = ListItem(List=ghpython_script_4.Max_min, Index=0, Wrap=True)  # -> Item, Item1
modeldisp_2 = ModelDisp(ghpython_script_4.ModelDisp)
max_min_2 = Max_min(ghpython_script_4.Max_min)
explode_tree_9 = ExplodeTree(Data=ghpython_script_4.ModelCurve)  # -> Branch0, Branch1, Branch2
construct_domain_2 = ConstructDomain(DomainStart=list_item_2.Item1, DomainEnd=list_item_2.Item)
divide_curve_2 = DivideCurve(Curve=explode_tree_9.Branch0, Count=explode_tree_9.Branch1, Kinks=False)  # -> Points, Tangents, simplify(Parameters)
dedomain_2 = DeconstructDomain(Domain=construct_domain_2)  # -> Start, End
shatter_2 = Shatter(Curve=graft(explode_tree_9.Branch0), Parameters=divide_curve_2.Parameters)  # -> simplify(Segments)
ghpython_script_5 = GhPythonScript(max=dedomain_2.End, min=dedomain_2.Start)  # -> out, color, tag, domain; same code as ghpython_script_3
curve_direction_3 = GhPythonScript(Crv=flatten(shatter_2), Thickness=Slider(3, range=0..10), RGB=explode_tree_9.Branch2)  # -> out; inputs Crv: list of Curve, RGB: list of Color; same code as curve_direction
lng_3 = ListLength(List=ghpython_script_5.domain)
planesrf_2 = PlaneSurface(Plane=PlaneXY(0, 0, 0), XSize=Slider(40, range=0..100), YSize=Slider(2, range=0..10))
divide_2 = DivideDomain²(Domain=planesrf_2, UCount=lng_3, VCount=1)
subsrf_2 = Isotrim(Surface=planesrf_2, Domain=divide_2)
mcol_2 = MeshColours(Mesh=graft(subsrf_2), Colours=graft(ghpython_script_5.color))
mjoin_2 = MeshJoin(Meshes=flatten(mcol_2))
pt_4 = ConstructPoint(XCoordinate=number_slider_14, YCoordinate=number_slider_13, ZCoordinate=0)
M_2 = Mesh(mjoin_2)
render_mesh_to_screen_2 = RenderMeshToScreen(Mesh=mjoin_2, Location=pt_4, ScaleFactor=number_slider_12, Depth=0.95, Fixed=True, m_scWithvp=False)

# ---- group: brick Displacement
python_36 = GhPythonScript(Code=read_file_13, OpenSeesOutputWrapper=analyze_3.OpenSeesOutputWrapper)  # -> Out, TagElement, Trans

# ---- group: Beam Displacement
python_37 = GhPythonScript(Code=read_file_10, OpenSeesOutputWrapper=analyze_3.OpenSeesOutputWrapper, NumberResults=number_slider_5)  # -> Out, TagElement, LocalTrans, LocalRot, GlobalTrans, GlobalRot

# ---- group: Shell Displacement
python_38 = GhPythonScript(Code=read_file_11, OpenSeesOutputWrapper=analyze_3.OpenSeesOutputWrapper)  # -> Out, TagElement, Trans, Rot

# ---- group: Displacement Nodes
python_39 = GhPythonScript(Code=read_file_12, OpenSeesOutputWrapper=analyze_3.OpenSeesOutputWrapper)  # -> Out, Points, Trans, Rot

# ----
list_item_3 = ListItem(List=ghpython_script_4.Max_min, Index=0, Wrap=True)
rec = DataRecorder(list_item_3, DataLimit=-10, RecordData=True)
graph_2 = QuickGraph(rec, SortOrder=0)

# ----
# Modal Animate
number_slider_17 = Slider(2, range=0..10)
path_8 = FilePath("C:\GitHub\Alpaca4d\PythonScript\Post-Processing\animateModal\animateModal.py")
list_10 = ValueList({"tx": 0, "ty": 1, "tz": 2}, selected="tx")
file_8 = ReadFile(File=path_8, PerLineParse=False)
planesrf_3 = PlaneSurface(Plane=PlaneXY(0, 0, 0), XSize=Slider(40, range=0..100), YSize=Slider(2, range=0..10))
pt_5 = ConstructPoint(XCoordinate=number_slider_11, YCoordinate=number_slider_10, ZCoordinate=0)

# ---- group: MODAL ANALYSIS
ghpython_script_6 = GhPythonScript(
    Code=file_8,
    OpenSeesOutputWrapper=analyze_2.OpenSeesOutputWrapper,
    NumberMode=Slider(2, range=0..10),
    Speed=Slider(1, range=1..20),
    Animate=Toggle(False),
    Reset=Button(),
    Scale=number_slider_17,
    Direction=list_10,
    ModelExstrud=Toggle(True))  # -> Out, ModelDisp, ModelCurve, Max_min; disabled

# ----
list_item_4 = ListItem(List=ghpython_script_6.Max_min, Index=0, Wrap=True)  # -> Item, Item1
modeldisp_3 = ModelDisp(ghpython_script_6.ModelDisp)
max_min_3 = Max_min(ghpython_script_6.Max_min)
explode_tree_10 = ExplodeTree(Data=ghpython_script_6.ModelCurve)  # -> Branch0, Branch1, Branch2
construct_domain_3 = ConstructDomain(DomainStart=list_item_4.Item1, DomainEnd=list_item_4.Item)
divide_curve_3 = DivideCurve(Curve=explode_tree_10.Branch0, Count=explode_tree_10.Branch1, Kinks=False)  # -> Points, Tangents, simplify(Parameters)
dedomain_3 = DeconstructDomain(Domain=construct_domain_3)  # -> Start, End
shatter_3 = Shatter(Curve=graft(explode_tree_10.Branch0), Parameters=divide_curve_3.Parameters)  # -> simplify(Segments)
ghpython_script_7 = GhPythonScript(max=dedomain_3.End, min=dedomain_3.Start)  # -> out, color, tag, domain; same code as ghpython_script_3
curve_direction_4 = GhPythonScript(Crv=flatten(shatter_3), Thickness=Slider(3, range=0..10), RGB=explode_tree_10.Branch2)  # -> out; inputs Crv: list of Curve, RGB: list of Color; same code as curve_direction
lng_4 = ListLength(List=ghpython_script_7.domain)
divide_3 = DivideDomain²(Domain=planesrf_3, UCount=lng_4, VCount=1)
subsrf_3 = Isotrim(Surface=planesrf_3, Domain=divide_3)
mcol_3 = MeshColours(Mesh=graft(subsrf_3), Colours=graft(ghpython_script_7.color))
mjoin_3 = MeshJoin(Meshes=flatten(mcol_3))
M_3 = Mesh(mjoin_3)
render_mesh_to_screen_3 = RenderMeshToScreen(Mesh=mjoin_3, Location=pt_5, ScaleFactor=number_slider_9, Depth=0.95, Fixed=True, m_scWithvp=False)
