# Grasshopper definition GrasshopperScriptTest.gh (Grasshopper 1.0.7)
# plug-ins: MeshEdit Components, Kangaroo Components, LunchBox, Weaverbird, Kangaroo2 Components, TetgenGH

brep = Brep(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)
mesh = MeshBrep(
    Brep=brep,
    Settings={GridMaxCount=0, GridMinCount=16, JaggedSeams=False, MaxEdgeLength=0, MinEdgeLength=0.0001, MinTolerance=0, Refine=True, RefineAngle=0, RelativeTolerance=0, SimplePlanes=True, Tolerance=0})
tetgen = Tetrahedralize(Mesh=mesh, Flags=Slider(0, range=0..10), MinRatio=Slider(1.3, range=0..10))  # -> Mesh, Indices, Points
deconstruct_mesh = DeconstructMesh(Mesh=tetgen.Mesh)  # -> Vertices, Faces, Colours, Normals
removeduplicatepts = RemoveDuplicatePts(Points=flatten(deconstruct_mesh.Vertices), Tolerance=0.01)
pdecon = Deconstruct(Point=removeduplicatepts)  # -> XComponent, YComponent, ZComponent
pdecon_2 = Deconstruct(Point=removeduplicatepts)  # -> XComponent, YComponent, ZComponent
larger_than = LargerThan(FirstNumber=pdecon.XComponent, SecondNumber="25")  # -> LargerThan, OrEqualTo
smaller = SmallerThan(FirstNumber=pdecon_2.XComponent, SecondNumber="0.1")  # -> SmallerThan, OrEqualTo
cull = CullPattern(List=removeduplicatepts, CullPattern=smaller.SmallerThan)  # -> graft(List)
cull_2 = CullPattern(List=removeduplicatepts, CullPattern=larger_than.LargerThan)  # -> graft(List)
point = Point(cull)
point_2 = Point(cull_2)
support = Point(point)
pointload = Point(point_2)
vec = VectorXYZ(XComponent=0, YComponent=0, ZComponent="-100")  # -> Vector, Length
entwine = Entwine(Branch03=support, Branch04=pointload, Branch05=vec.Vector, Branch012=graft(tetgen.Mesh), FlattenInputs=True)

number_slider = Slider(5, range=0..100)

# ---- group: Element
data = Data(0)
data_2 = Data(0)

# ---- group: Load
data_3 = Data(0)
data_4 = Data(0)

# ---- group: Cross-Section
data_5 = Data(0)
data_6 = Data(0)

# ---- group: Support
data_7 = Data(0)
data_8 = Data(0)

# ----
# Model 4
number_slider_2 = Slider(60, range=0..100)
construct_point = ConstructPoint(XCoordinate=0, YCoordinate=0, ZCoordinate=0)
construct_point_2 = ConstructPoint(XCoordinate=number_slider_2, YCoordinate=0, ZCoordinate=0)
unit_z = UnitZ(Factor=Slider(10, range=0..10))
line = Line(StartPoint=construct_point, EndPoint=construct_point_2)
move = Move(Geometry=line, Motion=unit_z)  # -> Geometry, Transform
panel = Panel(number_slider_2)
_2d_truss = _2DTruss(CurveA=line, CurveB=move.Geometry, Divisions=Slider(5, range=0..10), TrussToggle=0)  # -> PrimaryLines, BraceLines, VerticalLines, StructureNodes
pdecon_3 = Deconstruct(Point=_2d_truss.StructureNodes)  # -> XComponent, YComponent, ZComponent
pdecon_4 = Deconstruct(Point=_2d_truss.StructureNodes)  # -> XComponent, YComponent, ZComponent
equality = Equality(FirstNumber=pdecon_4.XComponent, SecondNumber=panel)  # -> Equality, Inequality
smaller_2 = SmallerThan(FirstNumber=pdecon_3.XComponent, SecondNumber="0.1")  # -> SmallerThan, OrEqualTo
merge = Merge(Data1=_2d_truss.PrimaryLines, Data2=_2d_truss.BraceLines, Data3=_2d_truss.VerticalLines)
cull_3 = CullPattern(List=_2d_truss.StructureNodes, CullPattern=equality.Equality)  # -> flatten(List)
cull_4 = CullPattern(List=_2d_truss.StructureNodes, CullPattern=smaller_2.SmallerThan)  # -> flatten(List)
vec_2 = VectorXYZ(XComponent=0, YComponent=0, ZComponent="-100")  # -> Vector, Length
pointload_2 = Point(cull_3)
support_2 = Point(cull_4)
beam = Curve(merge)
entwine_2 = Entwine(Branch01=beam, Branch03=support_2, Branch04=pointload_2, Branch05=vec_2.Vector, FlattenInputs=True)

series = Series(Start="0", Step="0.50", Count="2")

# ---- group: Material
data_9 = Data(0)
data_10 = Data(0)

# ---- group: Constraint
data_11 = Data(0)
data_12 = Data(0)

# ----
curve = Curve([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])

# ----
# Model 2
number_slider_3 = Slider(6, range=0..10)
vector_xyz = VectorXYZ(XComponent=0, YComponent=0, ZComponent=0)  # -> Vector, Length
vector_xyz_2 = VectorXYZ(XComponent=0, YComponent=0, ZComponent=number_slider_3)  # -> Vector, Length
move_2 = Move(Geometry=vector_xyz.Vector, Motion=vector_xyz_2.Vector)  # -> Geometry, Transform
line_2 = Line(StartPoint=vector_xyz.Vector, EndPoint=move_2.Geometry)
num = Number("0")
pointload_3 = Point(move_2.Geometry)
vec_3 = VectorXYZ(XComponent=0, YComponent=Slider(6, range=-20..20), ZComponent=0)  # -> Vector, Length
pointload_4 = Point(move_2.Geometry)
vec_4 = VectorXYZ(XComponent=Slider(0, range=-20..20), YComponent=0, ZComponent=0)  # -> Vector, Length
support_3 = Point(vector_xyz.Vector)
beam_2 = Curve(line_2)
columns = Curve(beam_2)
entwine_3 = Entwine(
    Branch01=beam_2,
    Branch03=support_3,
    Branch04=pointload_4,
    Branch05=vec_3.Vector,
    Branch06=columns,
    Branch07=vec_4.Vector,
    Branch010=pointload_3,
    Branch011=num,
    FlattenInputs=True)

# ----
# Model 1
number_slider_4 = Slider(10, range=0..40)
number_slider_5 = Slider(20, range=0..40)
panel_2 = Panel("2")
mesh_plane = MeshPlane(
    Boundary={Plane=PlaneXY(0, 0, 0), Size=Domain2(u=-10..10, v=-10..10)},
    WidthCount=number_slider_4,
    HeightCount=number_slider_4)  # -> Mesh, Area
shell = Mesh(mesh_plane.Mesh)
clean = CombineClean(Meshes=shell)
explode = MeshExplode(Mesh=clean, Interpolate=False)  # -> flatten(Faces)
demesh = DeconstructMesh(Mesh=clean)  # -> Vertices, Faces, Colours, Normals
area = Area(Geometry=mesh_plane.Mesh)  # -> Area, Centroid
area_2 = Area(Geometry=explode)  # -> Area, Centroid
distance = Distance(PointA=area.Centroid, PointB=area_2.Centroid)
bounds = Bounds(Numbers=distance)
nakedvertices = NakedVertices(Mesh=mesh_plane.Mesh)  # -> ClothedIndex, NakedIndex, ClothedPts, NakedPts
difference = SetDifference(SetA=demesh.Vertices, SetB=nakedvertices.NakedPts)
mc = MeshCorners(Mesh=clean, Angle=2.35619449)
deconstruct_domain = DeconstructDomain(Domain=bounds)  # -> Start, End
vec_5 = VectorXYZ(XComponent=Slider(17, range=-20..20), YComponent=Slider(20, range=-20..20), ZComponent=Slider(-100, range=-100..20))  # -> Vector, Length
maximum = Maximum(A=deconstruct_domain.Start, B=deconstruct_domain.End)
pointload_5 = Point(difference)
support_4 = Point(nakedvertices.NakedPts)
similarity = Similarity(FirstNumber=distance, SecondNumber=maximum, Threshold=Slider(1e-06, range=0..1e-06))  # -> Similarity, AbsoluteDifference
dispatch = Dispatch(List=explode, DispatchPattern=similarity.Similarity)  # -> ListA, ListB
entwine_4 = Entwine(Branch00=explode, Branch03=support_4, Branch04=pointload_5, Branch05=vec_5.Vector, FlattenInputs=True)

explode_2 = Explode(Curve=curve, Recursive=True)  # -> Segments, Vertices
unit_z_2 = UnitZ(Factor=series)
removeduplicatepts_2 = RemoveDuplicatePts(Points=flatten(explode_2.Vertices), Tolerance=0.01)
construct_domain = ConstructDomain(DomainStart=Slider(1, range=0..1), DomainEnd=Slider(8, range=0..10))
deconstruct = Deconstruct(Point=removeduplicatepts_2)  # -> XComponent, YComponent, ZComponent
vec_6 = VectorXYZ(XComponent=Slider(11, range=-20..20), YComponent=Slider(11, range=-20..20), ZComponent=0)  # -> Vector, Length
panel_3 = Panel("0.50")
smaller_than = SmallerThan(FirstNumber=deconstruct.ZComponent, SecondNumber="1")  # -> SmallerThan, OrEqualTo
series_2 = Series(Start="0", Step="0.50", Count=Slider(3, range=0..10))
list = ValueList({"Building": 0, "Shell": 1, "Cantiliver": 2, "Brick esaedro": 3, "Truss": 4, "telaio": 5, "Brick tetraedro": 6, "Building  2": 7}, selected="Cantiliver")
construct_domain_2 = ConstructDomain(DomainStart=Slider(1, range=0..1), DomainEnd=Slider(8, range=0..10))
dispatch_2 = Dispatch(List=removeduplicatepts_2, DispatchPattern=smaller_than.SmallerThan)  # -> ListA, ListB
unit_z_3 = UnitZ(Factor=series_2)
vec_7 = VectorXYZ(XComponent=Slider(11, range=-20..20), YComponent=Slider(11, range=-20..20), ZComponent=0)  # -> Vector, Length
addition = Addition(A="25", B=Slider(30, range=0..100))
vector_xyz_3 = VectorXYZ(XComponent=addition, YComponent=Slider(30, range=0..100), ZComponent=Slider(43, range=0..100))  # -> Vector, Length
point_3 = Point(vector_xyz_3.Vector)
line_3 = Line(StartPoint=cull_2, EndPoint=point_3)
item_index = ItemIndex(List=explode, Item=dispatch.ListA)
mesh_2 = Mesh(dispatch.ListA)

# ----
# UniaxialMaterial
# Elastic
file_path = FilePath("C:\GitHub\Alpaca4d\PythonScript\Pre-Processing\Material\uniAxialMaterial\ElasticUniaxialMaterial.py")
read_file = ReadFile(File=file_path, PerLineParse=False)
python = GhPythonScript(Code=read_file, MatName="S275", E="210000", G="80760", Rho="75", Fy="35")  # -> Out, UniaxialMaterial
python_2 = GhPythonScript(x=python.UniaxialMaterial)  # -> out, a
# ---------- python_2: Python ----------
a = x
# ---------- end python_2 ----------
panel_4 = Panel(python_2.a)

# ----
# UniaxialMaterial
# Elastic
panel_5 = Panel("210000")
python_3 = GhPythonScript(Code=read_file, MatName="S255", E=panel_5, G="80760", Rho="75", Fy="25")  # -> Out, UniaxialMaterial
python_4 = GhPythonScript(x=python_3.UniaxialMaterial)  # -> out, a; same code as python_2
panel_6 = Panel(python_4.a)

# ----
# nDMaterial
# ElasticIsotropic
file_path_2 = FilePath("C:\GitHub\Alpaca4d\PythonScript\Pre-Processing\Material\nDMaterial\ElasticIsotropic.py")
read_file_2 = ReadFile(File=file_path_2, PerLineParse=False)
python_5 = GhPythonScript(Code=read_file_2, MatName="S275", E="210000", G="80760", Rho="75", Fy="35")  # -> Out, NDMaterial

# ----
# Generic Cross Section
file_path_3 = FilePath("C:\GitHub\Alpaca4d\PythonScript\Pre-Processing\Section\GenericCrossSection.py")
read_file_3 = ReadFile(File=file_path_3, PerLineParse=False)
python_6 = GhPythonScript(
    Code=read_file_3,
    SectionName="Generic",
    Area="20",
    Ay="20",
    Az="20",
    Iyy="20",
    Izz="20",
    J="20",
    UniaxialMaterial=python.UniaxialMaterial)  # -> Out, CrossSection

file_path_4 = FilePath("C:\GitHub\Alpaca4d\PythonScript\Pre-Processing\Load\BeamLoad.py")

# ----
# WIP
panel_7 = Panel("100")
random = Random(Range="20", Number=panel_7, Seed=2)
random_2 = Random(Range="20", Number=panel_7, Seed="3")
pt = ConstructPoint(XCoordinate=random, YCoordinate=random_2, ZCoordinate=0)
python_7 = GhPythonScript(Pos=pt, RigidDiaphragm=Toggle(True))  # -> Out, A

# ----
# Circular CrossSection
file_path_5 = FilePath("C:\GitHub\Alpaca4d\PythonScript\Pre-Processing\Section\CircularCrossSection.py")
read_file_4 = ReadFile(File=file_path_5, PerLineParse=False)
python_8 = GhPythonScript(Code=read_file_4, SectionName="CHS", Diameter="400", Thickness="40", UniaxialMaterial=python_3.UniaxialMaterial)  # -> Out, CrossSection

# ----
# Elastic Membrane Plate Section
file_path_6 = FilePath("C:\GitHub\Alpaca4d\PythonScript\Pre-Processing\Section\ElasticMembranePlateSection.py")
read_file_5 = ReadFile(File=file_path_6, PerLineParse=False)
python_9 = GhPythonScript(Code=read_file_5, SectionName="concreteSlab", Thickness="700", NDMaterial=python_5.NDMaterial)  # -> Out, CrossSection

read_file_6 = ReadFile(File=file_path_4, PerLineParse=False)

# ----
# doubleT CrossSection
file_path_7 = FilePath("C:\GitHub\Alpaca4d\PythonScript\Pre-Processing\Section\doubleTCrossSection.py")
read_file_7 = ReadFile(File=file_path_7, PerLineParse=False)
python_10 = GhPythonScript(
    Code=read_file_7,
    SectionName="TT",
    Bsup="300",
    Binf="600",
    H="500",
    Tsup="100",
    Tinf="100",
    Tw="100",
    UniaxialMaterial=python_3.UniaxialMaterial)  # -> Out, CrossSection

# ---- group: Rectangular Hollow Cross Section
file_path_8 = FilePath("C:\GitHub\Alpaca4d\PythonScript\Pre-Processing\Section\RectangularHollowCrossSection.py")
read_file_8 = ReadFile(File=file_path_8, PerLineParse=False)
python_11 = GhPythonScript(Code=read_file_8, SectionName="RHS", Base="300", Height="300", Thickness="25", UniaxialMaterial=python.UniaxialMaterial)  # -> Out, CrossSection

# ----
# Rectangular Cross Section
file_path_9 = FilePath("C:\GitHub\Alpaca4d\PythonScript\Pre-Processing\Section\RectangularCrossSection.py")
read_file_9 = ReadFile(File=file_path_9, PerLineParse=False)
python_12 = GhPythonScript(Code=read_file_9, SectionName="RHS", Base="300", Height="300", UniaxialMaterial=python.UniaxialMaterial)  # -> Out, CrossSection

file_path_10 = FilePath("C:\GitHub\Alpaca4d\PythonScript\Pre-Processing\Element\Brick\BbarBrick.py")
read_file_10 = ReadFile(File=file_path_10, PerLineParse=False)
path = FilePath("C:\GitHub\Alpaca4d\PythonScript\Analyses\LinearAnalyses\initializeAnalysis.py")
# solver on folder Static Analyses 3ndf
# solver on folder Static Analyses
path_2 = FilePath("C:\GitHub\Alpaca4d\PythonScript\Analyses\openSees_StaticSolver_3ndf\initializeAnalysis_3ndf.py")  # disabled
# solver on folder Static Analyses
file = ReadFile(File=path, PerLineParse=False)
file_2 = ReadFile(File=path_2, PerLineParse=False)  # disabled
# we can skip some data point. We don't need to read all of them. This can help to make it faster.
# 
# OR
# 
# We can read ALL the files and show only some output.
number_slider_6 = Slider(5, range=1..10)
panel_8 = Panel("10")
path_3 = FilePath("C:\GitHub\Alpaca4d\PythonScript\Post-Processing\viewGroundAccAnalyses\viewGroundAccAnalyses.py")
file_3 = ReadFile(File=path_3, PerLineParse=False)

# ----
# Brick component
list_2 = ValueList({"8Color": 0, "20Color": 1}, selected="20Color")  # disabled

# ----
# Disp Numerical Ouput
# OK!
number_slider_7 = Slider(10, range=0..10)
file_path_11 = FilePath("C:\GitHub\Alpaca4d\PythonScript\Post-Processing\beamDisp\beamDisp.py")
file_path_12 = FilePath("C:\GitHub\Alpaca4d\PythonScript\Post-Processing\nodalDisp\nodalDisp.py")
file_path_13 = FilePath("C:\GitHub\Alpaca4d\PythonScript\Post-Processing\brickDisp\brickDisp.py")
file_path_14 = FilePath("C:\GitHub\Alpaca4d\PythonScript\Post-Processing\shellDisp\shellDisp.py")
read_file_11 = ReadFile(File=file_path_11, PerLineParse=False)
read_file_12 = ReadFile(File=file_path_14, PerLineParse=False)
read_file_13 = ReadFile(File=file_path_12, PerLineParse=False)
read_file_14 = ReadFile(File=file_path_13, PerLineParse=False)

mesh_plane_2 = MeshPlane(
    Boundary={Plane=PlaneXY(0, 0, 0), Size=Domain2(u=-10..10, v=-10..10)},
    WidthCount=Slider(3, range=0..100),
    HeightCount=Slider(3, range=0..100))  # -> Mesh, Area
number_slider_8 = Slider(10, range=0..100)
subtraction = Subtraction(A=number_slider_8, B="1")
deconstruct_mesh_2 = DeconstructMesh(Mesh=mesh_plane_2.Mesh)  # -> Vertices, Faces, Colours, Normals
series_3 = Series(Start="0", Step="3", Count=number_slider_8)
series_4 = Series(Start="3", Step="3", Count=subtraction)
removeduplicatepts_3 = RemoveDuplicatePts(Points=flatten(deconstruct_mesh_2.Vertices), Tolerance=0.01)
unit_z_4 = UnitZ(Factor=series_3)
unit_z_5 = UnitZ(Factor=series_4)
move_3 = Move(Geometry=graft(removeduplicatepts_3), Motion=unit_z_4)  # -> simplify(Geometry), Transform
move_4 = Move(Geometry=graft(mesh_plane_2.Mesh), Motion=unit_z_5)  # -> Geometry, Transform
shift_list = ShiftList(List=move_3.Geometry, Shift=1, Wrap=True)
deconstruct_mesh_3 = DeconstructMesh(Mesh=move_4.Geometry)  # -> Vertices, Faces, Colours, Normals
removeduplicatepts_4 = RemoveDuplicatePts(Points=flatten(deconstruct_mesh_3.Vertices), Tolerance=0.01)
pdecon_5 = Deconstruct(Point=removeduplicatepts_4)  # -> XComponent, YComponent, ZComponent
larger_than_2 = LargerThan(FirstNumber=pdecon_5.XComponent, SecondNumber="9")  # -> LargerThan, OrEqualTo
mesh_explode = MeshExplode(Mesh=move_4.Geometry, Interpolate=False)
vincoli = Point(removeduplicatepts_3)
cull_5 = CullPattern(List=removeduplicatepts_4, CullPattern=larger_than_2.LargerThan)  # -> flatten(List)
vec_8 = VectorXYZ(XComponent="-100", YComponent=0, ZComponent=0)  # -> Vector, Length
pointload_6 = Point(cull_5)
support_5 = Point(vincoli)

cull_nth = CullNth(List=simplify(shift_list), CullFrequency=number_slider_8)
cull_nth_2 = CullNth(List=simplify(move_3.Geometry), CullFrequency=number_slider_8)
refine = Refine(Mesh=mesh_explode, Level="0")
mesh_explode_2 = MeshExplode(Mesh=refine, Interpolate=False)

line_4 = Line(StartPoint=cull_nth_2, EndPoint=cull_nth)  # -> flatten(Line)
colonne = RemoveDuplicateLines(Lines=line_4, Tolerance=0.01)
entwine_5 = Entwine(
    Branch00=mesh_explode_2,
    Branch01=colonne,
    Branch03=support_5,
    Branch04=pointload_6,
    Branch05=vec_8.Vector,
    FlattenInputs=True)

rectangle = Rectangle(Plane=PlaneXY(0, 0, 0), XSize="10", YSize="20", Radius=0)  # -> Rectangle, Length
mesh_surface = MeshSurface(Surface=rectangle.Rectangle, UCount=number_slider, VCount=number_slider, Overhang=True, Equalize=False)
weaverbird_s_offset_mesh = WeaverbirdsOffsetMesh(MeshCurves=mesh_surface, Distance=graft(series), OffsetType=0)
entwine_6 = Entwine(Branch00=mesh_surface, Branch01=weaverbird_s_offset_mesh, FlattenInputs=True)
subtraction_2 = Subtraction(A="10", B="1")
vec_9 = VectorXYZ(XComponent=0, YComponent=0, ZComponent="-100")  # -> Vector, Length

move_5 = Move(Geometry=mesh_surface, Motion=unit_z_2)  # -> flatten(Geometry), Transform

# ---- group: brith to loft mesh
ghpython_script = GhPythonScript(MeshSeries=move_5.Geometry, color=ColourSwatch(SwatchColor=RGB(4, 0, 255)))  # -> out, simplify(flatten(Brick)); inputs MeshSeries: list of Mesh
# ---------- ghpython_script: Python ----------
import Rhino.Geometry as rg

def MeshToShell(Mesh):
    
    Mesh.Unweld(0, True)
    mesh = Mesh.ExplodeAtUnweldedEdges()
    newMesh = []
    elementType = []
    for explodedMesh in mesh:
        newMesh.append(explodedMesh)
    return newMesh 

def brick( MeshList, color ):
    meshExpl = []
    Vertix = []
    elementType = []
    solid = []
    
    for Mesh in MeshList:
        shellWrapper = MeshToShell(Mesh)
        meshExpl.append( shellWrapper )
    for index1 in range(0, len(MeshList)-1):
        for index2 in range(0, len(meshExpl[0])):
            if meshExpl[ index1 ][ index2 ].Vertices.Count == 4:
                
                elementType.append("stdBrick")
                vertix1 = meshExpl[ index1 ][ index2 ].Vertices[0]
                vertix2 = meshExpl[ index1 ][ index2 ].Vertices[1]
                vertix3 = meshExpl[ index1 ][ index2 ].Vertices[2]
                vertix4 = meshExpl[ index1 ][ index2 ].Vertices[3]
                vertix5 = meshExpl[index1 + 1 ][ index2].Vertices[0]
                vertix6 = meshExpl[index1 + 1 ][ index2].Vertices[1]
                vertix7 = meshExpl[index1 + 1 ][ index2].Vertices[2]
                vertix8 = meshExpl[index1 + 1 ][ index2].Vertices[3]
                
                vertix = [ vertix1, vertix2, vertix3, vertix4,
                vertix5, vertix6, vertix7, vertix8 ]
                
                ele = rg.Mesh()
                
                ele.Vertices.Add( vertix1 ) # 0 
                ele.Vertices.Add( vertix2 ) # 1
                ele.Vertices.Add( vertix3 ) # 2
                ele.Vertices.Add( vertix4 ) # 3
                ele.Vertices.Add( vertix5 ) # 4
                ele.Vertices.Add( vertix6 ) # 5
                ele.Vertices.Add( vertix7 ) # 6
                ele.Vertices.Add( vertix8 ) # 7
                
                ele.VertexColors.Add(color)
                ele.VertexColors.Add(color)
                ele.VertexColors.Add(color)
                ele.VertexColors.Add(color)
                ele.VertexColors.Add(color)
                ele.VertexColors.Add(color)
                ele.VertexColors.Add(color)
                ele.VertexColors.Add(color)
    
                
                ele.Faces.AddFace(0, 1, 2, 3) # 0
                ele.Faces.AddFace(4, 5, 6, 7) # 1
                ele.Faces.AddFace(0, 1, 5, 4) # 2
                ele.Faces.AddFace(3, 2, 6, 7) # 3
                ele.Faces.AddFace(1, 5, 6, 2) # 4
                ele.Faces.AddFace(0, 4, 7, 3) # 5
                #ele.IsClosed()
                
            else :
                elementType.append(["FourNodeTetrahedron"]*3)
                
                if meshExpl[ index1 ][ index2 ].Vertices[0] == meshExpl[index1 + 1 ][ index2].Vertices[0] :
                    vertix1 = meshExpl[ index1 ][ index2 ].Vertices[0]
                    vertix2 = meshExpl[ index1 ][ index2 ].Vertices[1]
                    vertix3 = meshExpl[ index1 ][ index2 ].Vertices[2]
                    vertix4 = meshExpl[index1 + 1 ][ index2].Vertices[1]
                    vertix5 = meshExpl[index1 + 1 ][ index2].Vertices[2]
                    
                    vertixEle1 = [ vertix1, vertix2, vertix3, vertix4 ]
                    vertixEle2 = [ vertix1, vertix2, vertix3, vertix2 ]
                    
                    ele1 = rg.Mesh() # Tetrahedron 1
                    ele2 = rg.Mesh() # Tetrahedron 2
                    
                    ele1.Vertices.Add( vertix1 ) # 0 
                    ele1.Vertices.Add( vertix2 ) # 1
                    ele1.Vertices.Add( vertix3 ) # 2 
                    ele1.Vertices.Add( vertix4 ) # 3 
                    
                    ele1.VertexColors.Add(color)
                    ele1.VertexColors.Add(color)
                    ele1.VertexColors.Add(color)
                    ele1.VertexColors.Add(color)
                    
                    ele2.Vertices.Add( vertix1 ) # 0 
                    ele2.Vertices.Add( vertix2 ) # 1 
                    ele2.Vertices.Add( vertix3 ) # 2 
                    ele2.Vertices.Add( vertix2 ) # 3
    
                    ele2.VertexColors.Add(color)
                    ele2.VertexColors.Add(color)
                    ele2.VertexColors.Add(color)
                    ele2.VertexColors.Add(color)
                    
                    ele1.Faces.AddFace(0, 1, 4 ) # 0
                    ele1.Faces.AddFace(0, 1, 3 ) # 1
                    ele1.Faces.AddFace(0, 4, 3 ) # 2
                    ele1.Faces.AddFace(1, 3, 4 ) # 3
                    
                    ele2.Faces.AddFace(0, 1, 3 ) # 0
                    ele2.Faces.AddFace(0, 1, 2 ) # 1
                    ele2.Faces.AddFace(1, 2, 3 ) # 2
                    ele2.Faces.AddFace(0, 2, 3 ) # 3
                    
                    ele = [ ele1, ele2 ]
                    
                else :
                
                    vertix1 = meshExpl[ index1 ][ index2 ].Vertices[0]
                    vertix2 = meshExpl[ index1 ][ index2 ].Vertices[1]
                    vertix3 = meshExpl[ index1 ][ index2 ].Vertices[2]
                    vertix4 = meshExpl[index1 + 1 ][ index2].Vertices[0]
                    vertix5 = meshExpl[index1 + 1 ][ index2].Vertices[1]
                    vertix6 = meshExpl[index1 + 1 ][ index2].Vertices[2]
                    
                    vertixEle1 = [ vertix1, vertix2, vertix3, vertix6 ]
                    vertixEle2 = [ vertix4, vertix5, vertix6, vertix1 ]
                    vertixEle3 = [ vertix5, vertix6, vertix2, vertix1 ]
                    
                    vertix = [ vertixEle1, vertixEle2, vertixEle3 ]
                    
                    ele1 = rg.Mesh() # Tetrahedron 1
                    ele2 = rg.Mesh() # Tetrahedron 2
                    ele3 = rg.Mesh() # Tetrahedron 3
                    
                    ele1.Vertices.Add( vertix1 ) # 0 
                    ele1.Vertices.Add( vertix2 ) # 1
                    ele1.Vertices.Add( vertix3 ) # 2 
                    ele1.Vertices.Add( vertix6 ) # 3 
                    
                    ele1.VertexColors.Add(color)
                    ele1.VertexColors.Add(color)
                    ele1.VertexColors.Add(color)
                    ele1.VertexColors.Add(color)
                    
                    ele2.Vertices.Add( vertix4 ) # 0 
                    ele2.Vertices.Add( vertix5 ) # 1 
                    ele2.Vertices.Add( vertix6 ) # 2 
                    ele2.Vertices.Add( vertix1 ) # 3
    
                    ele2.VertexColors.Add(color)
                    ele2.VertexColors.Add(color)
                    ele2.VertexColors.Add(color)
                    ele2.VertexColors.Add(color)
                    
                    ele3.Vertices.Add( vertix5 ) # 0 
                    ele3.Vertices.Add( vertix6 ) # 1 
                    ele3.Vertices.Add( vertix2 ) # 2 
                    ele3.Vertices.Add( vertix1 ) # 3
                    
                    ele3.VertexColors.Add(color)
                    ele3.VertexColors.Add(color)
                    ele3.VertexColors.Add(color)
                    ele3.VertexColors.Add(color)
                    
                    ele1.Faces.AddFace(0, 1, 2 ) # 0
                    ele1.Faces.AddFace(0, 3, 1 ) # 1
                    ele1.Faces.AddFace(0, 3, 2 ) # 2
                    ele1.Faces.AddFace(1, 3, 2 ) # 3
                    
                    ele2.Faces.AddFace(0, 1, 2 ) # 0
                    ele2.Faces.AddFace(0, 3, 1 ) # 1
                    ele2.Faces.AddFace(0, 3, 2 ) # 2
                    ele2.Faces.AddFace(1, 3, 2 ) # 3
                    
                    ele3.Faces.AddFace(0, 1, 2 ) # 0
                    ele3.Faces.AddFace(0, 3, 1 ) # 1
                    ele3.Faces.AddFace(0, 3, 2 ) # 2
                    ele3.Faces.AddFace(1, 3, 2 ) # 3
                    
                    ele = [ ele1, ele2, ele3 ]
            
            solid.append(ele)
            Vertix.append( vertix )
    return solid, elementType

Brick, type = brick( MeshSeries, color )
# ---------- end ghpython_script ----------

# ----
move_6 = Move(Geometry=graft(ghpython_script.Brick), Motion=unit_z_3)  # -> flatten(Geometry), Transform

# ----
# Model 0
number_slider_9 = Slider(-20, range=-20..20)
vec_10 = VectorXYZ(XComponent=number_slider_9, YComponent=0, ZComponent=0)  # -> Vector, Length
pointload_7 = Point([Point(0, 0, 10), Point(5, 0, 10), Point(0, 5, 5), Point(0, 5, 10), Point(0, 0, 5)])
vec_11 = VectorXYZ(XComponent=Slider(0, range=-20..20), YComponent=0, ZComponent=0)  # -> Vector, Length
support_6 = Point([Point(0, 0, 0), Point(5, 0, 0), Point(10, 0, 0), Point(15, 0, 0), Point(15, 5, 0), Point(10, 5, 0), Point(5, 5, 0), Point(0, 5, 0)])
shell_2 = Mesh([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])
beam_3 = Curve([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])
truss = Curve([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])
cantiliver = Curve([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])
columns_2 = Curve([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])
vec_12 = VectorXYZ(XComponent=0, YComponent=Slider(11, range=-20..20), ZComponent=0)  # -> Vector, Length
refine_2 = Refine(Mesh=shell_2, Level="2")
mesh_3 = Mesh(refine_2)
clean_2 = CombineClean(Meshes=mesh_3)
explode_3 = MeshExplode(Mesh=clean_2, Interpolate=False)  # -> flatten(Faces)

list_length = ListLength(List=pointload_7)
range = Range(Domain=construct_domain, Steps=list_length)
multiplication = Multiplication(A=vec_6.Vector, B=range)
custom_preview = CustomPreview(Geometry=support_6, Material=ColourSwatch(SwatchColor=RGB(0, 0, 0)))

entwine_7 = Entwine(
    Branch00=explode_3,
    Branch01=beam_3,
    Branch02=truss,
    Branch03=support_6,
    Branch04=pointload_7,
    Branch05=vec_10.Vector,
    Branch06=columns_2,
    Branch07=vec_11.Vector,
    Branch08=cantiliver,
    Branch09=vec_12.Vector,
    Branch010=pointload_7,
    Branch011=multiplication,
    FlattenInputs=True)

# ----
# Model 5
number_slider_10 = Slider(-20, range=-20..20)
vec_13 = VectorXYZ(XComponent=number_slider_10, YComponent=0, ZComponent=0)  # -> Vector, Length
vec_14 = VectorXYZ(XComponent=Slider(0, range=-20..20), YComponent=0, ZComponent=0)  # -> Vector, Length
beam_4 = Curve(curve)
pointload_8 = Point(dispatch_2.ListB)
support_7 = Point(dispatch_2.ListA)

list_length_2 = ListLength(List=pointload_8)
range_2 = Range(Domain=construct_domain_2, Steps=list_length_2)
multiplication_2 = Multiplication(A=vec_7.Vector, B=range_2)

entwine_8 = Entwine(
    Branch01=beam_4,
    Branch03=support_7,
    Branch04=pointload_8,
    Branch05=vec_13.Vector,
    Branch07=vec_14.Vector,
    Branch010=pointload_8,
    Branch011=multiplication_2,
    FlattenInputs=True)

deconstruct_mesh_4 = DeconstructMesh(Mesh=ghpython_script.Brick)  # -> Vertices, Faces, Colours, Normals
ghpython_script_2 = GhPythonScript(x=ghpython_script.Brick)  # -> out, flatten(a); same code as python_2
removeduplicatepts_5 = RemoveDuplicatePts(Points=flatten(deconstruct_mesh_4.Vertices), Tolerance=0.01)
pdecon_6 = Deconstruct(Point=removeduplicatepts_5)  # -> XComponent, YComponent, ZComponent
smaller_3 = SmallerThan(FirstNumber=pdecon_6.XComponent, SecondNumber="0.1")  # -> SmallerThan, OrEqualTo
larger_than_3 = LargerThan(FirstNumber=pdecon_6.XComponent, SecondNumber=subtraction_2)  # -> LargerThan, OrEqualTo
cull_6 = CullPattern(List=removeduplicatepts_5, CullPattern=smaller_3.SmallerThan)  # -> graft(List)
cull_7 = CullPattern(List=removeduplicatepts_5, CullPattern=larger_than_3.LargerThan)  # -> graft(List)
point_4 = Point(cull_7)
pointload_9 = Point(point_4)
support_8 = Point(cull_6)
entwine_9 = Entwine(Branch03=support_8, Branch04=pointload_9, Branch05=vec_9.Vector, Branch012=ghpython_script.Brick, FlattenInputs=True)

dispatch_3 = Dispatch(List=removeduplicatepts_5, DispatchPattern=smaller_3.SmallerThan)  # -> ListA, ListB

point_5 = Point(dispatch_3.ListA)

stream_filter = StreamFilter(
    Gate=list,
    Stream0=entwine_7,
    Stream1=entwine_4,
    Stream2=entwine_3,
    Stream3=entwine_9,
    Stream4=entwine_2,
    Stream5=entwine_8,
    Stream6=entwine,
    Stream7=entwine_5)
explode_tree = ExplodeTree(Data=stream_filter)  # -> Branch0, Branch1, Branch2, Branch3, Branch4, Branch5, Branch6, Branch7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

pointload_10 = Point(explode_tree.Branch4)
vector = Data(explode_tree.Branch5)

support_9 = Point(explode_tree.Branch3)
shell_3 = Mesh(explode_tree.Branch0)
beam_5 = Curve(explode_tree.Branch1)
truss_2 = Curve(explode_tree.Branch2)

data_13 = Data(explode_tree.Branch6)
vector_2 = Data(explode_tree.Branch7)

data_14 = Data(explode_tree.Branch8)
vector_3 = Data(explode_tree.Branch9)

data_15 = Data(explode_tree.Branch10)
mass = Data(explode_tree.Branch11)

brick = Data(explode_tree.Branch12)

# ----
# Support
file_path_15 = FilePath("C:\GitHub\Alpaca4d\PythonScript\Pre-Processing\Element\Support\Support.py")
toggle = BooleanToggle(True)
read_file_15 = ReadFile(File=file_path_15, PerLineParse=False)
point_6 = Point(support_9)
python_13 = GhPythonScript(Code=read_file_15, Pos=graft(point_6), Tx=toggle, Ty=Toggle(True), Tz=toggle, Rx=toggle, Ry=toggle, Rz=toggle)  # -> Out, flatten(SupportWrapper)
python_14 = GhPythonScript(x=python_13.SupportWrapper)  # -> out, a; same code as python_2
panel_9 = Panel(python_14.a)

# ----
# Linear Load
value_list = ValueList({"LocalAxis": 0, "GlobalAxis": 1}, selected="GlobalAxis")
vector_4 = Vector(vector_2)
crv = Curve(data_13)
python_15 = GhPythonScript(Code=read_file_6, Force=vector_4, Element=crv, Orientation=value_list)  # -> Out, flatten(BeamUniformLoad)

# ----
# Linear Load
value_list_2 = ValueList({"LocalAxis": 0, "GlobalAxis": 1}, selected="GlobalAxis")
vector_5 = Vector(vector_3)
crv_2 = Curve(data_14)
python_16 = GhPythonScript(Code=read_file_6, Force=vector_5, Element=crv_2, Orientation=value_list_2)  # -> Out, flatten(BeamUniformLoad)

# ----
# Point Load
file_path_16 = FilePath("C:\GitHub\Alpaca4d\PythonScript\Pre-Processing\Load\PointLoad.py")
read_file_16 = ReadFile(File=file_path_16, PerLineParse=False)
vector_6 = Vector(expr("x*0", Vector(2.518385542, -6.656153768, 0)))
vector_7 = Vector(vector)
point_7 = Point(pointload_10)
python_17 = GhPythonScript(Code=read_file_16, Force=vector_7, Moment=vector_6, Pos=point_7)  # -> Out, flatten(LoadWrapper)

# ----
# MassLoad
num_2 = Number(mass)
pt_2 = Point(data_15)
path_4 = FilePath("C:\GitHub\Alpaca4d\PythonScript\Pre-Processing\Load\MassLoad.py")
file_4 = ReadFile(File=path_4, PerLineParse=False)
python_18 = GhPythonScript(Code=file_4, NodalMass=num_2, Pos=pt_2)  # -> Out, flatten(Mass)

# ----
# meshToShell
mesh_4 = Mesh(shell_3)
file_path_17 = FilePath("C:\GitHub\Alpaca4d\PythonScript\Pre-Processing\Element\MeshToShell\MeshToShell.py")
read_file_17 = ReadFile(File=file_path_17, PerLineParse=False)
python_19 = GhPythonScript(Code=read_file_17, Mesh=mesh_4, CrossSection=python_9.CrossSection)  # -> Out, flatten(ShellWrapper)

crv_3 = Curve(truss_2)

# ----
# LineToBeam
file_path_18 = FilePath("C:\GitHub\Alpaca4d\PythonScript\Pre-Processing\Element\LineToBeam\LineToBeam.py")
read_file_18 = ReadFile(File=file_path_18, PerLineParse=False)
crv_4 = Curve(beam_5)
python_20 = GhPythonScript(Code=read_file_18, Line=crv_4, CrossSection=python_10.CrossSection)  # -> Out, flatten(BeamWrapper)

data_16 = Data([python_15.BeamUniformLoad, python_16.BeamUniformLoad, python_17.LoadWrapper])

# ----
# LineToTruss
list_3 = ValueList({"Truss": 0, "Beam": 1}, selected="Truss")
swatch = ColourSwatch(SwatchColor=RGB(255, 200, 0))
python_21 = GhPythonScript(Code=read_file_18, Line=crv_3, CrossSection=python_8.CrossSection, OrientSection="0", BeamType=list_3)  # -> Out, flatten(BeamWrapper)

# ----
# Solid
swatch_2 = ColourSwatch(SwatchColor=RGB(0, 72, 255))
python_22 = GhPythonScript(Code=read_file_10, Brick=brick, Colour=swatch_2, NDMaterial=python_5.NDMaterial)  # -> Out, flatten(SolidWrapper)

item = ListItem(List=python_22.SolidWrapper, Index=0, Wrap=True)  # -> Item, Item1
python_23 = GhPythonScript(x=item.Item)  # -> out, simplify(a); same code as python_2
python_24 = GhPythonScript(x=python_23.a)  # -> out, simplify(a); same code as python_2
python_25 = GhPythonScript(x=python_24.a)  # -> out, simplify(a); same code as python_2
merge_2 = Merge(Data1=python_19.ShellWrapper, Data2=python_20.BeamWrapper, Data3=python_21.BeamWrapper, Data4=python_22.SolidWrapper)
panel_10 = Panel(python_25.a)
clean_tree = CleanTree(RemoveNulls=True, RemoveInvalid=True, RemoveEmpty=False, Tree=merge_2)
clean_tree_2 = CleanTree(RemoveNulls=True, RemoveInvalid=True, RemoveEmpty=False, Tree=python_13.SupportWrapper)
clean_tree_3 = CleanTree(RemoveNulls=True, RemoveInvalid=True, RemoveEmpty=False, Tree=data_16)
clean_tree_4 = CleanTree(RemoveNulls=True, RemoveInvalid=True, RemoveEmpty=False, Tree=python_18.Mass)

# ----
# Assemble
file_path_19 = FilePath("C:\GitHub\Alpaca4d\PythonScript\Pre-Processing\Assemble\Assemble.py")
read_file_19 = ReadFile(File=file_path_19, PerLineParse=False)
python_26 = GhPythonScript(
    Code=read_file_19,
    Element=flatten(clean_tree),
    Support=flatten(clean_tree_2),
    Load=flatten(clean_tree_3),
    Mass=flatten(clean_tree_4))  # -> Out, AlpacaModel, MassOfStructure

panel_11 = Panel(python_26.MassOfStructure)
data_17 = Data(python_26.AlpacaModel)

# ----
# modelView
# da fare a cluster
# OK!
file_path_20 = FilePath("C:\GitHub\Alpaca4d\PythonScript\Post-Processing\modelView\modelView.py")
read_file_20 = ReadFile(File=file_path_20, PerLineParse=False)
python_27 = GhPythonScript(
    Code=read_file_20,
    AlpacaModel=data_17,
    ModelExstrud=Toggle(False),
    Load=Toggle(False),
    Support=Toggle(True),
    NodalMass=Toggle(True))  # -> ModelView, LineModel, ForceDisplay, Support, LocalAxis, TagNode, TagEle, Mass
explode_tree_2 = ExplodeTree(Data=python_27.LocalAxis)  # -> Branch0, Branch1, Branch2, Branch3
explode_tree_3 = ExplodeTree(Data=python_27.LineModel)  # -> Branch0, Branch1
geo = Geometry(python_27.ModelView)
geo_2 = Geometry(geo)
explode_tree_4 = ExplodeTree(Data=simplify(python_27.TagNode))  # -> Branch0, Branch1
explode_tree_5 = ExplodeTree(Data=simplify(python_27.TagEle))  # -> Branch0, Branch1
explode_tree_6 = ExplodeTree(Data=simplify(python_27.Mass))  # -> Branch0, Branch1
explode_tree_7 = ExplodeTree(Data=python_27.ForceDisplay)  # -> Branch0, Branch1
curve_direction = GhPythonScript(Crv=explode_tree_3.Branch0, Thickness=Slider(3, range=0..10), RGB=explode_tree_3.Branch1)  # -> out; inputs Crv: list of Curve, RGB: list of Color
# ---------- curve_direction: Python ----------
from ghpythonlib.componentbase import executingcomponent as component
import Grasshopper, GhPython
import System
import Rhino as rh
import rhinoscriptsyntax as rs
import Rhino.Geometry as rg


class CurveColor(component):

    def RunScript(self,Crv,Thickness,RGB):
        self.C = Crv
        self.RGB = RGB
        self.t = Thickness
        if not self.C: return
            
    def DrawViewportWires(self,arg):
        if not  self.C: return
        for curve, color in zip( self.C, self.RGB ):
            arg.Display.DrawCurve(curve, color,self.t)
# ---------- end curve_direction ----------
custom_preview_2 = CustomPreview(Geometry=python_27.Support, Material=ColourSwatch(SwatchColor=RGB(164, 252, 0)))
vector_display_ex = VectorDisplayEx(Point=explode_tree_7.Branch0, Vector=explode_tree_7.Branch1, Colour=ColourSwatch(SwatchColor=RGB(176, 32, 32)), Width=2)
vector_display_ex_2 = VectorDisplayEx(Point=explode_tree_2.Branch0, Vector=explode_tree_2.Branch1, Colour=ColourSwatch(SwatchColor=RGB(252, 0, 0)), Width=2)
vector_display_ex_3 = VectorDisplayEx(Point=explode_tree_2.Branch0, Vector=explode_tree_2.Branch2, Colour=ColourSwatch(SwatchColor=RGB(0, 245, 53)), Width=2)
vector_display_ex_4 = VectorDisplayEx(Point=explode_tree_2.Branch0, Vector=explode_tree_2.Branch3, Colour=ColourSwatch(SwatchColor=RGB(0, 55, 255)), Width=2)
dot_display = DotDisplay(Point=explode_tree_6.Branch0, Colour=ColourSwatch(SwatchColor=RGB(107, 106, 102)), Size=explode_tree_6.Branch1)
tag = TextTag(Location=explode_tree_4.Branch0, Text=explode_tree_4.Branch1, Colour=ColourSwatch(SwatchColor=RGB(255, 0, 0)))
tag_2 = TextTag(Location=explode_tree_5.Branch0, Text=explode_tree_5.Branch1, Colour=ColourSwatch(SwatchColor=RGB(25, 0, 255)))

data_18 = Data(python_26.AlpacaModel)

# ----
# Modal Analyses
path_5 = FilePath("C:\GitHub\Alpaca4d\PythonScript\Analyses\DynamicAnalysis\initializeModalAnalyses.py")
file_5 = ReadFile(File=path_5, PerLineParse=False)
analyze = GhPythonScript(Code=file_5, AlpacaModel=data_18, NumVibrationModes="5")  # -> Out, AlpacaModalOutput, Frequency, Period

data_19 = Data(python_26.AlpacaModel)
analyze_2 = GhPythonScript(Code=file, AlpacaModel=python_26.AlpacaModel)  # -> Out, AlpacaStaticOutput, MaxDisplacement
analyze_3 = GhPythonScript(Code=file_2, AlpacaModel=python_26.AlpacaModel)  # -> Out, AlpacaStaticOutput; disabled
panel_12 = Panel(python_27.ForceDisplay)
panel_13 = Panel(analyze.Frequency)
merge_3 = Merge(Data1=analyze_2.AlpacaStaticOutput, Data2=analyze_3.AlpacaStaticOutput)  # -> flatten(Result)
merge_4 = Merge(Data1=analyze_2.AlpacaStaticOutput, Data2=analyze_3.AlpacaStaticOutput)  # -> flatten(Result)

# ---- group: Reaction Forces
# Reactions
number_slider_11 = Slider(10, range=0..100)  # disabled
file_path_21 = FilePath("C:\GitHub\Alpaca4d\PythonScript\Post-Processing\reaction\reaction.py")  # disabled
toggle_2 = BooleanToggle(True)  # disabled
read_file_21 = ReadFile(File=file_path_21, PerLineParse=False)  # disabled
toggle_3 = BooleanToggle(True)  # disabled
python_28 = GhPythonScript(
    Code=read_file_21,
    AlpacaStaticOutput=analyze_2.AlpacaStaticOutput,
    ReactionForcesView=toggle_3,
    ReactionMomentsView=toggle_2,
    Scale=number_slider_11)  # -> Out, TagPoints, ReactionForce, ReactionMoment, View; disabled
reactionforce = ReactionForce(python_28.ReactionForce)  # disabled
tagpoints = TagPoints(python_28.TagPoints)  # disabled
reactionmoment = ReactionMoment(python_28.ReactionMoment)  # disabled
explode_tree_8 = ExplodeTree(Data=python_28.View)  # -> Branch0, Branch1, Branch2, Branch3, Branch4, Branch5, Branch6; disabled
colour_swatch = ColourSwatch(SwatchColor=RGB(252, 0, 0))  # disabled
colour_swatch_2 = ColourSwatch(SwatchColor=RGB(0, 55, 255))  # disabled
vector_display_ex_5 = VectorDisplayEx(
    Point=explode_tree_8.Branch0,
    Vector=[explode_tree_8.Branch3, explode_tree_8.Branch2, explode_tree_8.Branch1],
    Colour=colour_swatch,
    Width=2)  # disabled
vector_display_ex_6 = VectorDisplayEx(
    Point=explode_tree_8.Branch0,
    Vector=[explode_tree_8.Branch6, explode_tree_8.Branch5, explode_tree_8.Branch4],
    Colour=colour_swatch_2,
    Width=2)  # disabled

# ---- group: Cds Visualisation
# CDS view
number_slider_12 = Slider(0.675, range=0.001..10)  # disabled
file_path_22 = FilePath("C:\GitHub\Alpaca4d\PythonScript\Post-Processing\cdsView\cdsView.py")  # disabled
read_file_22 = ReadFile(File=file_path_22, PerLineParse=False)  # disabled
list_4 = ValueList({"N": 0, "V1": 1, "V2": 2, "M2": 3, "M1": 4, "Mt": 5}, selected="N")  # disabled
python_29 = GhPythonScript(Code=read_file_22, AlpacaStaticOutput=analyze_2.AlpacaStaticOutput, Cds=list_4)  # disabled

# ---- group: Beam Forces
# CDS valor
number_slider_13 = Slider(10, range=0..10)  # disabled
file_path_23 = FilePath("C:\GitHub\Alpaca4d\PythonScript\Post-Processing\beamForces\beamForces.py")  # disabled
# beam Component
read_file_23 = ReadFile(File=file_path_23, PerLineParse=False)  # disabled
python_30 = GhPythonScript(Code=read_file_23, AlpacaStaticOutput=analyze_2.AlpacaStaticOutput)  # -> Out, TagElement, N, V1, V2, Mt, M1, M2; disabled

# ---- group: nD Stress Visualisation
# Stress view & valor
file_path_24 = FilePath("C:\GitHub\Alpaca4d\PythonScript\Post-Processing\brickStress\brickStress.py")  # disabled
read_file_24 = ReadFile(File=file_path_24, PerLineParse=False)  # disabled
list_5 = ValueList({"sigmaX": 0, "sigmaY": 1, "sigmaZ": 2, "tauXY": 3, "tauXZ": 4, "tauYZ": 5}, selected="tauYZ")  # disabled
python_31 = GhPythonScript(Code=read_file_24, AlpacaStaticOutput=analyze_3.AlpacaStaticOutput, StressView=list_5)  # -> Brick, StressValue; disabled
bounds_2 = Bounds(Numbers=flatten(python_31.StressValue))  # disabled
deconstruct_domain_2 = DeconstructDomain(Domain=bounds_2)  # -> Start, End; disabled
ghpython_script_3 = GhPythonScript(min=deconstruct_domain_2.Start, max=deconstruct_domain_2.End, value=python_31.StressValue, nColor=list_2)  # -> out, color, tag, domain, colorValue; inputs value: list, nColor: Int32; disabled
# ---------- ghpython_script_3: Python ----------
import Rhino.Geometry as rg
import ghpythonlib.components as ghcomp
import math as mt
import ghpythonlib.treehelpers as th # per data tree
import Grasshopper
#import System as sy #DV
import sys
import rhinoscriptsyntax as rs

'''
ghFilePath = ghenv.LocalScope.ghdoc.Path
ghFileName = ghenv.LocalScope.ghdoc.Name
folderNameLength = len(ghFilePath)-len(ghFileName)-2 #have to remove '.gh'
ghFolderPath = ghFilePath[0:folderNameLength]

outputPath = ghFolderPath + 'assembleData'
wrapperFile = ghFolderPath + 'assembleData\\openSeesModel.txt'

userObjectFolder = Grasshopper.Folders.DefaultUserObjectFolder
fileName = userObjectFolder + 'Alpaca'
'''
fileName = r'C:\GitHub\Alpaca4d\PythonScript\function'
sys.path.append(fileName)
# importante mettere import 'import Rhino.Geometry as rg' prima di importatre DomeFunc
import DomeFunc as dg 
def gradientJet(value, valueMax, valueMin, nColor):
    if nColor == 0:
        listcolo = [rs.CreateColor( 0, 0, 255 ),
                    rs.CreateColor( 0, 128, 255 ),
                    rs.CreateColor( 0, 255, 255 ),
                    rs.CreateColor( 0, 255, 128 ),
                    rs.CreateColor( 128, 255, 0 ),
                    rs.CreateColor( 255, 255, 0 ),
                    rs.CreateColor( 255, 128, 0 ),
                    rs.CreateColor( 204, 0, 0 )]
    elif nColor == 1:
        listcolo = [ rs.CreateColor( 0, 0, 102 ),
                    rs.CreateColor( 0, 0, 255 ),
                    rs.CreateColor( 0, 64, 255 ),
                    rs.CreateColor( 0, 128, 255 ),
                    rs.CreateColor( 0, 191, 255 ),
                    rs.CreateColor( 0, 255, 255 ),
                    rs.CreateColor( 0, 255, 191 ),
                    rs.CreateColor( 0, 255, 128 ),
                    rs.CreateColor( 0, 255, 64 ),
                    rs.CreateColor( 0, 255, 0 ),
                    rs.CreateColor( 64, 255, 0 ),
                    rs.CreateColor( 128, 255, 0 ),
                    rs.CreateColor( 191, 255, 0 ),
                    rs.CreateColor( 255, 255, 0 ),
                    rs.CreateColor( 255, 191, 0 ),
                    rs.CreateColor( 255, 128, 0 ),
                    rs.CreateColor( 255, 64, 0 ),
                    rs.CreateColor( 255, 0, 0 ),
                    rs.CreateColor( 230, 0, 0 ),
                    rs.CreateColor( 204, 0, 0 )]
    #domain = linspace( valueMin,  valueMax, len( listcolo ) )
    n = len( listcolo )
    domain = dg.linspace( valueMin, valueMax, n)
    
    for i in range(1,n):
        if  domain[i-1] <= value <= domain[i]:
            return listcolo[ i ]
        elif  valueMax <= value <= valueMax + 0.00001 :
            return listcolo[ -1 ]
        elif  valueMin - 0.00000000001 <= value <= valueMin  :
            return listcolo[ 0 ]

def gradientJet2(valueMax, valueMin, nColor ):

    if nColor == 0:
        listcolo = [rs.CreateColor( 0, 0, 255 ),
                    rs.CreateColor( 0, 128, 255 ),
                    rs.CreateColor( 0, 255, 255 ),
                    rs.CreateColor( 0, 255, 128 ),
                    rs.CreateColor( 128, 255, 0 ),
                    rs.CreateColor( 255, 255, 0 ),
                    rs.CreateColor( 255, 128, 0 ),
                    rs.CreateColor( 204, 0, 0 )]
    elif nColor == 1:
        listcolo = [ rs.CreateColor( 0, 0, 102 ),
                    rs.CreateColor( 0, 0, 255 ),
                    rs.CreateColor( 0, 64, 255 ),
                    rs.CreateColor( 0, 128, 255 ),
                    rs.CreateColor( 0, 191, 255 ),
                    rs.CreateColor( 0, 255, 255 ),
                    rs.CreateColor( 0, 255, 191 ),
                    rs.CreateColor( 0, 255, 128 ),
                    rs.CreateColor( 0, 255, 64 ),
                    rs.CreateColor( 0, 255, 0 ),
                    rs.CreateColor( 64, 255, 0 ),
                    rs.CreateColor( 128, 255, 0 ),
                    rs.CreateColor( 191, 255, 0 ),
                    rs.CreateColor( 255, 255, 0 ),
                    rs.CreateColor( 255, 191, 0 ),
                    rs.CreateColor( 255, 128, 0 ),
                    rs.CreateColor( 255, 64, 0 ),
                    rs.CreateColor( 255, 0, 0 ),
                    rs.CreateColor( 230, 0, 0 ),
                    rs.CreateColor( 204, 0, 0 )]

    #domain = linspace( valueMin,  valueMax, len( listcolo ) )
    n = len( listcolo )
    diff = (float(valueMax) - valueMin)/( n - 1 )
    domain = [diff * i + valueMin  for i in range(n)]
    return [ listcolo, domain ]

colorList = gradientJet2( max, min, nColor )
color = colorList[0]  #.reverse()
color.reverse()
tag = []
tag.append( str(round(colorList[1][0],2) ) )
for i in range(1,len(colorList[1])):
    tag.append( str(round(colorList[1][i-1],2)) + '< valor < ' + str(round(colorList[1][i],2)) )
domain = colorList[1]
tag.reverse()

colorValue = []
for i in value:
    colorValue.append(gradientJet(i, max, min, nColor))
    print(len(value))
# ---------- end ghpython_script_3 ----------
panel_14 = Panel("{0}")  # disabled
panel_15 = Panel("{0}")  # disabled
panel_16 = Panel("{0}")  # disabled
split_tree = SplitTree(Data=simplify(ghpython_script_3.color), Masks=simplify(panel_14))  # -> Positive, Negative; disabled
split_tree_2 = SplitTree(Data=simplify(ghpython_script_3.tag), Masks=simplify(panel_15))  # -> Positive, Negative; disabled
mesh_colours = MeshColours(Mesh=graft(python_31.Brick), Colours=ghpython_script_3.colorValue)  # disabled
split_tree_3 = SplitTree(Data=simplify(ghpython_script_3.domain), Masks=simplify(panel_16))  # -> Positive, Negative; disabled

# ---- group: shell Force Visualisation
# Forces view
# da riguardare per i valori
file_path_25 = FilePath("C:\GitHub\Alpaca4d\PythonScript\Post-Processing\shellForceView\shellForceView.py")  # disabled
read_file_25 = ReadFile(File=file_path_25, PerLineParse=False)  # disabled
list_6 = ValueList({"8Color": 0, "20Color": 1}, selected="8Color")  # disabled
list_7 = ValueList({"Fx": 0, "Fy": 1, "Fz": 2, "Mx": 3, "My": 4, "Mz": 5}, selected="Fx")  # disabled
python_32 = GhPythonScript(Code=read_file_25, AlpacaStaticOutput=analyze_2.AlpacaStaticOutput, ViewForce=list_7)  # -> ModelForce, ForceValue; disabled
bounds_3 = Bounds(Numbers=flatten(python_32.ForceValue))  # disabled
file_path_26 = FilePath("C:\GitHub\Alpaca4d\PythonScript\function\AlpacaColorMesh.py")  # disabled
deconstruct_domain_3 = DeconstructDomain(Domain=bounds_3)  # -> Start, End; disabled
read_file_26 = ReadFile(File=file_path_26, PerLineParse=False)  # disabled
ghpython_script_4 = GhPythonScript(
    Code=read_file_26,
    Min=deconstruct_domain_3.Start,
    Max=deconstruct_domain_3.End,
    Value=python_32.ForceValue,
    NColor=list_6)  # -> Out, Color, Tag, Domain, ColorValue; disabled
panel_17 = Panel("{0}")  # disabled
panel_18 = Panel("{0}")  # disabled
panel_19 = Panel("{0}")  # disabled
split_tree_4 = SplitTree(Data=simplify(ghpython_script_4.Color), Masks=simplify(panel_17))  # -> Positive, Negative; disabled
split_tree_5 = SplitTree(Data=simplify(ghpython_script_4.Tag), Masks=simplify(panel_18))  # -> Positive, Negative; disabled
split_tree_6 = SplitTree(Data=simplify(ghpython_script_4.Domain), Masks=simplify(panel_19))  # -> Positive, Negative; disabled
mesh_colours_2 = MeshColours(Mesh=graft(python_32.ModelForce), Colours=ghpython_script_4.ColorValue)  # disabled
positive = Positive(split_tree_5.Positive)  # disabled
mesh_5 = Mesh(mesh_colours_2)  # disabled
positive_2 = Positive(split_tree_4.Positive)  # disabled

# ---- group: shell Forces
# Forces valor
file_path_27 = FilePath("C:\GitHub\Alpaca4d\PythonScript\Post-Processing\shellForces\shellForces.py")  # disabled
read_file_27 = ReadFile(File=file_path_27, PerLineParse=False)  # disabled
python_33 = GhPythonScript(Code=read_file_27, AlpacaStaticOutput=analyze_2.AlpacaStaticOutput)  # -> Out, TagElement, Fx, Fy, Fz, Mx, My, Mz; disabled

# ----
# displacement Component
# deformedModelView
# OK!
number_slider_14 = Slider(1172, range=0..10000)
file_path_28 = FilePath("C:\GitHub\Alpaca4d\PythonScript\Post-Processing\defModelView\defModelView.py")
read_file_28 = ReadFile(File=file_path_28, PerLineParse=False)
list_8 = ValueList({"tx": 0, "ty": 1, "tz": 2}, selected="tz")
python_34 = GhPythonScript(Code=read_file_28, AlpacaStaticOutput=merge_3, Direction=list_8, Scale=number_slider_14, ModelExstrud=Toggle(False))  # -> Out, ModelDisp, ModelCurve, Max_min
modeldisp = ModelDisp(python_34.ModelDisp)
max_min = Max_min(python_34.Max_min)
explode_tree_9 = ExplodeTree(Data=python_34.ModelCurve)  # -> Branch0, Branch1, Branch2
divide_curve = DivideCurve(Curve=explode_tree_9.Branch0, Count=explode_tree_9.Branch1, Kinks=False)  # -> Points, Tangents, simplify(Parameters)
shatter = Shatter(Curve=graft(explode_tree_9.Branch0), Parameters=divide_curve.Parameters)  # -> simplify(Segments)
curve_direction_2 = GhPythonScript(Crv=flatten(shatter), Thickness=Slider(2, range=0..10), RGB=explode_tree_9.Branch2)  # -> out; inputs Crv: list of Curve, RGB: list of Color; same code as curve_direction

# ---- group: brick Displacement
python_35 = GhPythonScript(Code=read_file_14, AlpacaStaticOutput=analyze_3.AlpacaStaticOutput)  # -> Out, TagElement, Trans

# ---- group: Shell Displacement
python_36 = GhPythonScript(Code=read_file_12, AlpacaStaticOutput=analyze_2.AlpacaStaticOutput)  # -> Out, TagElement, Trans, Rot

# ---- group: Beam Displacement
python_37 = GhPythonScript(Code=read_file_11, AlpacaStaticOutput=analyze_2.AlpacaStaticOutput, NumberResults=number_slider_7)  # -> Out, TagElement, LocalTrans, LocalRot, GlobalTrans, GlobalRot

# ---- group: NodeDisp
python_38 = GhPythonScript(Code=read_file_13, AlpacaStaticOutput=merge_4)  # -> Out, Points, Trans, Rot

# ----
# Force component
panel_20 = Panel(python_33.Fx)  # disabled

# ----
# OK!
file_path_29 = FilePath("C:\GitHub\Alpaca4d\PythonScript\Post-Processing\disassembleModel\disassembleModel.py")  # disabled
read_file_29 = ReadFile(File=file_path_29, PerLineParse=False)  # disabled

# ---- group: disassemble Model
python_39 = GhPythonScript(Code=read_file_29, AlpacaModel=python_26.AlpacaModel)  # -> ModelView, ModelViewExtruded, Points, Support, Load, Material, Section; disabled

# ----
panel_21 = Panel(python_39.ModelViewExtruded)  # disabled

# ----
# EarthQuake Analyses
path_6 = FilePath("C:\GitHub\Alpaca4d\PythonScript\Analyses\EarthQuakeAnalysis\BM68elc.acc")
path_7 = FilePath("C:\GitHub\Alpaca4d\PythonScript\Analyses\EarthQuakeAnalysis\initializeEarthQuakeAnalysis.py")
list_9 = ValueList({"x": 1, "y": 2, "z": 3}, selected="y")
file_6 = ReadFile(File=path_7, PerLineParse=False)

file_7 = ReadFile(File=path_6, PerLineParse=False)
split = TextSplit(Text=file_7, Separators=" ")
division = Division(A=split, B="1")
clean_3 = CleanTree(RemoveNulls=True, RemoveInvalid=True, RemoveEmpty=invert(False), Tree=division)
graph = QuickGraph(clean_3, SortOrder=0)
lng = ListLength(List=clean_3)
multiplication_3 = Multiplication(A=lng, B="0.01")
earthquake_file_seconds = Panel(multiplication_3)

series_5 = Series(Start=0, Step="0.01", Count=lng)

analyze_4 = GhPythonScript(
    Code=file_6,
    AlpacaModel=data_19,
    TmaxAnalyses="10",
    GroundMotionDirection=list_9,
    GroundMotionValues=clean_3,
    GroundMotionTimeStep=series_5,
    GroundMotionFactor="100",
    TimeStepIncrement="0.005",
    Damping=0.02,
    NewmarkGamma=0.5,
    NewmarkBeta=0.25)  # -> Out, AlpacaGroundmotionOutput, MaxDisplacement, MinDisplacement

panel_22 = Panel(analyze_4.MaxDisplacement)
panel_23 = Panel(analyze_4.MinDisplacement)

number_slider_15 = Slider(114, range=0..1000)
toggle_4 = BooleanToggle(True)
button = Button()
toggle_5 = BooleanToggle(False)
list_10 = ValueList({"tx": 0, "ty": 1, "tz": 2}, selected="ty")
ghpython_script_5 = GhPythonScript(
    Code=file_3,
    OpenSeesOutputWrapper=analyze_4.AlpacaGroundmotionOutput,
    Speed=number_slider_6,
    Animate=toggle_5,
    Reset=button,
    Scale=number_slider_15,
    Direction=list_10,
    ModelExstrud=toggle_4)  # -> Out, ModelDisp, ModelCurve, Trans, Rot
modeldisp_2 = ModelDisp(ghpython_script_5.ModelDisp)
explode_tree_10 = ExplodeTree(Data=ghpython_script_5.ModelCurve)  # -> _00000, Branch1, Branch2
divide_curve_2 = DivideCurve(Curve=explode_tree_10._00000, Count=explode_tree_10.Branch1, Kinks=False)  # -> Points, Tangents, simplify(Parameters)
shatter_2 = Shatter(Curve=graft(explode_tree_10._00000), Parameters=divide_curve_2.Parameters)  # -> simplify(Segments)
curve_direction_3 = GhPythonScript(Crv=flatten(shatter_2), Thickness=Slider(3, range=0..10), RGB=explode_tree_10.Branch2)  # -> out; inputs Crv: list of Curve, RGB: list of Color; same code as curve_direction

ghpython_script_6 = GhPythonScript(
    openSeesOutputWrapper=analyze_4.AlpacaGroundmotionOutput,
    speed=number_slider_6,
    Animate=toggle_5,
    Reset=button,
    scale=number_slider_15,
    direction=list_10,
    modelExstrud=toggle_4)  # -> out, ModelDisp, ModelCurve, trans, rot; inputs openSeesOutputWrapper: list, speed: Int32; disabled
# ---------- ghpython_script_6: Python ----------
import Rhino.Geometry as rg
import math as mt
import ghpythonlib.treehelpers as th # per data tree
import Grasshopper as gh
import sys
import rhinoscriptsyntax as rs
import Rhino.Display as rd
from scriptcontext import doc
import time



fileName = r'C:\GitHub\Alpaca4d\PythonScript\function'
sys.path.append(fileName)
# importante mettere import 'import Rhino.Geometry as rg' prima di importatre DomeFunc
import DomeFunc as dg
#---------------------------------------------------------#

## Funzione cerchio ##
def AddCircleFromCenter( plane, radius):
    t = dg.linspace( 0 , 1.80*mt.pi, 15 )
    a = []
    for ti in t:
        x = radius*mt.cos(ti)
        y = radius*mt.sin(ti)
        a.append( plane.PointAt( x, y ) )
    #circle = rg.PolylineCurve( a )
    circle  = a 
    return circle

def AddIFromCenter(plane, Bsup, tsup, Binf, tinf, H, ta, yg):
    #-------------------1---------2 #
    '''
    p1 = plane.PointAt(ta/2, -(yg - tinf) )
    p2 = plane.PointAt( Binf/2,  -(yg - tinf) )
    p3 = plane.PointAt( Binf/2,  -yg )
    p4 = plane.PointAt( -Binf/2,  -yg )
    p5 = plane.PointAt( -Binf/2, -(yg - tinf) ) 
    p6 = plane.PointAt( -ta/2,  -(yg - tinf) )
    p7 = plane.PointAt( -ta/2,  (H - yg - tsup))
    p8 = plane.PointAt( -Bsup/2,  (H - yg - tsup) )
    p9 = plane.PointAt( -Bsup/2,  (H - yg ) )
    p10 = plane.PointAt( Bsup/2,  (H - yg ) )
    p11 = plane.PointAt( Bsup/2,  (H - yg - tsup) )
    p12 = plane.PointAt( ta/2,  (H - yg - tsup) )
    '''
    p1 = plane.PointAt( -(yg - tinf), ta/2 )
    p2 = plane.PointAt( -(yg - tinf), Binf/2 )
    p3 = plane.PointAt( -yg, Binf/2 )
    p4 = plane.PointAt( -yg, -Binf/2 )
    p5 = plane.PointAt( -(yg - tinf), -Binf/2 ) 
    p6 = plane.PointAt( -(yg - tinf), -ta/2 )
    p7 = plane.PointAt( (H - yg - tsup), -ta/2)
    p8 = plane.PointAt( (H - yg - tsup), -Bsup/2 )
    p9 = plane.PointAt( (H - yg ), -Bsup/2 )
    p10 = plane.PointAt( (H - yg ), Bsup/2 )
    p11 = plane.PointAt( (H - yg - tsup), Bsup/2 )
    p12 = plane.PointAt( (H - yg - tsup), ta/2 )

    wirframe  = [ p1, p2, p3, p4, p5, p6, p7, p8, p9, p10, p11, p12 ] 
    return wirframe

def defShellQuad( ele, node, nodeDisp, scaleDef ):
    
    eleTag = ele[0]
    eleNodeTag = ele[1]
    color = ele[2][2]
    thick = ele[2][1]
    #print( eleNodeTag )
    #print( eleNodeTag )
    index1 = eleNodeTag[0] 
    index2 = eleNodeTag[1] 
    index3 = eleNodeTag[2] 
    index4 = eleNodeTag[3] 
    
    trasl1 = nodeDisp.get( index1 , "never")[0]
    rotate1 = nodeDisp.get( index1 , "never")[1]
    
    trasl2 = nodeDisp.get( index2 , "never")[0]
    rotate2 = nodeDisp.get( index2 , "never")[1]
    
    trasl3 = nodeDisp.get( index3 , "never")[0]
    rotate3 = nodeDisp.get( index3 , "never")[1]
    
    trasl4 = nodeDisp.get( index4 , "never")[0]
    rotate4 = nodeDisp.get( index4 , "never")[1]
    
    ## CREO IL MODELLO DEFORMATO  ##
    
    pointDef1 = rg.Point3d.Clone( node.get( index1 , "never") )
    pointDef2 = rg.Point3d.Clone( node.get( index2 , "never") )
    pointDef3 = rg.Point3d.Clone( node.get( index3 , "never") )
    pointDef4 = rg.Point3d.Clone( node.get( index4 , "never") )
    #print( index1 - 1)
    #print( nodeDisp )
    vectortrasl1 = rg.Transform.Translation( rg.Vector3d(trasl1.X, trasl1.Y, trasl1.Z)*scaleDef )
    pointDef1.Transform( vectortrasl1 )
    vectortrasl2 = rg.Transform.Translation( rg.Vector3d(trasl2.X, trasl2.Y, trasl2.Z)*scaleDef )
    pointDef2.Transform( vectortrasl2 )
    vectortrasl3 = rg.Transform.Translation( rg.Vector3d(trasl3.X, trasl3.Y, trasl3.Z)*scaleDef )
    pointDef3.Transform( vectortrasl3 )
    vectortrasl4 = rg.Transform.Translation( rg.Vector3d(trasl4.X, trasl4.Y, trasl4.Z)*scaleDef )
    pointDef4.Transform( vectortrasl4 )
    shellDefModel = rg.Mesh()
    shellDefModel.Vertices.Add( pointDef1 ) #0
    shellDefModel.Vertices.Add( pointDef2 ) #1
    shellDefModel.Vertices.Add( pointDef3 ) #2
    shellDefModel.Vertices.Add( pointDef4 ) #3
    
    
    shellDefModel.Faces.AddFace(0, 1, 2, 3)
    colour = rs.CreateColor( color[0], color[1], color[2] )
    shellDefModel.VertexColors.CreateMonotoneMesh( colour )

    vt = shellDefModel.Vertices
    shellDefModel.FaceNormals.ComputeFaceNormals()
    fid,MPt = shellDefModel.ClosestPoint(vt[0],0.01)
    normalFace = shellDefModel.FaceNormals[fid]
    vectormoltiplicate = rg.Vector3d.Multiply( -normalFace, thick/2 )
    trasl = rg.Transform.Translation( vectormoltiplicate )
    moveShell = rg.Mesh.DuplicateMesh(shellDefModel)
    moveShell.Transform( trasl )
    extrudeShell = rg.Mesh.Offset( moveShell, thick, True, normalFace)
    return  [shellDefModel,[trasl1, trasl2, trasl3, trasl4], [rotate1, rotate2, rotate3, rotate4], extrudeShell ]

def defShellTriangle( ele, node, nodeDisp, scaleDef ):
    
    eleTag = ele[0]
    eleNodeTag = ele[1]
    color = ele[2][1]
    index1 = eleNodeTag[0] - 1
    index2 = eleNodeTag[1] - 1
    index3 = eleNodeTag[2] - 1
    
    trasl1 = nodeDisp.get( index1 , "never")[0]
    rotate1 = nodeDisp.get( index1  , "never")[1]
    
    trasl2 = nodeDisp.get( index2 , "never")[0]
    rotate2 = nodeDisp.get( index2 , "never")[1]
    
    trasl3 = nodeDisp.get( index3 , "never")[0]
    rotate3 = nodeDisp.get( index3 , "never")[1]
    
    ## CREO IL MODELLO DEFORMATO  ##
    pointDef1 = rg.Point3d.Clone( node.get( index1 , "never") )
    pointDef2 = rg.Point3d.Clone( node.get( index2 , "never") )
    pointDef3 = rg.Point3d.Clone( node.get( index3 , "never") )
    vectortrasl1 = rg.Transform.Translation( rg.Vector3d(trasl1.X, trasl1.Y, trasl1.Z)*scaleDef )
    pointDef1.Transform( vectortrasl1 )
    vectortrasl2 = rg.Transform.Translation( rg.Vector3d(trasl2.X, trasl2.Y, trasl2.Z)*scaleDef )
    pointDef2.Transform( vectortrasl2 )
    vectortrasl3 = rg.Transform.Translation( rg.Vector3d(trasl3.X, trasl3.Y, trasl3.Z)*scaleDef )
    pointDef3.Transform( vectortrasl3 )
    shellDefModel = rg.Mesh()
    shellDefModel.Vertices.Add( pointDef1 ) #0
    shellDefModel.Vertices.Add( pointDef2 ) #1
    shellDefModel.Vertices.Add( pointDef3 ) #2
    
    shellDefModel.Faces.AddFace(0, 1, 2)
    colour = rs.CreateColor( color[0], color[1], color[2] )
    vt = shellDefModel.Vertices
    shellDefModel.FaceNormals.ComputeFaceNormals()
    fid,MPt = shellDefModel.ClosestPoint(vt[0],0.01)
    normalFace = shellDefModel.FaceNormals[fid]
    vectormoltiplicate = rg.Vector3d.Multiply( -normalFace, thick/2 )
    trasl = rg.Transform.Translation( vectormoltiplicate )
    moveShell = rg.Mesh.DuplicateMesh(shellDefModel)
    moveShell.Transform( trasl )
    extrudeShell = rg.Mesh.Offset( moveShell, thick, True, normalFace)
    return  [shellDefModel,[trasl1, trasl2, trasl3], [rotate1, rotate2, rotate3], extrudeShell ]

def defSolid( ele, node, nodeDisp, scaleDef ):
    
    eleTag = ele[0]
    eleNodeTag = ele[1]
    color = ele[2][1]
    thick = ele[2][1]
    #print( eleNodeTag )
    index1 = eleNodeTag[0] - 1
    index2 = eleNodeTag[1] - 1
    index3 = eleNodeTag[2] - 1
    index4 = eleNodeTag[3] - 1
    index5 = eleNodeTag[4] - 1
    index6 = eleNodeTag[5] - 1
    index7 = eleNodeTag[6] - 1
    index8 = eleNodeTag[7] - 1
    
    trasl1 = nodeDisp.get( index1 , "never")
    trasl2 = nodeDisp.get( index2 , "never")
    trasl3 = nodeDisp.get( index3 , "never")
    trasl4 = nodeDisp.get( index4 , "never")
    trasl5 = nodeDisp.get( index5 , "never")
    trasl6 = nodeDisp.get( index6 , "never")
    trasl7 = nodeDisp.get( index7 , "never")
    trasl8 = nodeDisp.get( index8 , "never")
    
    ## CREO IL MODELLO DEFORMATO  ##
    pointDef1 = rg.Point3d.Clone( node.get( index1 , "never") )
    pointDef2 = rg.Point3d.Clone( node.get( index2 , "never") )
    pointDef3 = rg.Point3d.Clone( node.get( index3 , "never") )
    pointDef4 = rg.Point3d.Clone( node.get( index4 , "never") )
    pointDef5 = rg.Point3d.Clone( node.get( index5 , "never") )
    pointDef6 = rg.Point3d.Clone( node.get( index6 , "never") )
    pointDef7 = rg.Point3d.Clone( node.get( index7 , "never") )
    pointDef8 = rg.Point3d.Clone( node.get( index8 , "never") )
    vectortrasl1 = rg.Transform.Translation( rg.Vector3d(trasl1.X, trasl1.Y, trasl1.Z)*scaleDef )
    pointDef1.Transform( vectortrasl1 )
    vectortrasl2 = rg.Transform.Translation( rg.Vector3d(trasl2.X, trasl2.Y, trasl2.Z)*scaleDef )
    pointDef2.Transform( vectortrasl2 )
    vectortrasl3 = rg.Transform.Translation( rg.Vector3d(trasl3.X, trasl3.Y, trasl3.Z)*scaleDef )
    pointDef3.Transform( vectortrasl3 )
    vectortrasl4 = rg.Transform.Translation( rg.Vector3d(trasl4.X, trasl4.Y, trasl4.Z)*scaleDef )
    pointDef4.Transform( vectortrasl4 )
    vectortrasl5 = rg.Transform.Translation( rg.Vector3d(trasl5.X, trasl5.Y, trasl5.Z)*scaleDef )
    pointDef5.Transform( vectortrasl1 )
    vectortrasl6 = rg.Transform.Translation( rg.Vector3d(trasl6.X, trasl6.Y, trasl6.Z)*scaleDef )
    pointDef6.Transform( vectortrasl2 )
    vectortrasl7 = rg.Transform.Translation( rg.Vector3d(trasl7.X, trasl7.Y, trasl7.Z)*scaleDef )
    pointDef7.Transform( vectortrasl3 )
    vectortrasl8 = rg.Transform.Translation( rg.Vector3d(trasl8.X, trasl8.Y, trasl8.Z)*scaleDef )
    pointDef8.Transform( vectortrasl4 )
    
    shellDefModel = rg.Mesh()
    shellDefModel.Vertices.Add( pointDef1 ) #0
    shellDefModel.Vertices.Add( pointDef2 ) #1
    shellDefModel.Vertices.Add( pointDef3 ) #2
    shellDefModel.Vertices.Add( pointDef4 ) #3
    shellDefModel.Vertices.Add( pointDef5 ) #4
    shellDefModel.Vertices.Add( pointDef6 ) #5
    shellDefModel.Vertices.Add( pointDef7 ) #6
    shellDefModel.Vertices.Add( pointDef8 ) #7

    shellDefModel.Faces.AddFace(0, 1, 2, 3)
    shellDefModel.Faces.AddFace(4, 5, 6, 7)
    shellDefModel.Faces.AddFace(0, 1, 5, 4)
    shellDefModel.Faces.AddFace(1, 2, 6, 5)
    shellDefModel.Faces.AddFace(2, 3, 7, 6)
    shellDefModel.Faces.AddFace(3, 0, 4, 7)
    
    colour = rs.CreateColor( color[0], color[1], color[2] )
    shellDefModel.VertexColors.CreateMonotoneMesh( colour )
    return  [shellDefModel,[trasl1, trasl2, trasl3,trasl4, trasl5, trasl6, trasl7, trasl8 ]]

def defTetraSolid( ele, node, nodeDisp, scaleDef ):
    
    eleTag = ele[0]
    eleNodeTag = ele[1]
    color = ele[2][1]
    #print( eleNodeTag )
    index1 = eleNodeTag[0] - 1
    index2 = eleNodeTag[1] - 1
    index3 = eleNodeTag[2] - 1
    index4 = eleNodeTag[3] - 1
    
    trasl1 = nodeDisp.get( index1 , "never")
    trasl2 = nodeDisp.get( index2 , "never")
    trasl3 = nodeDisp.get( index3 , "never")
    trasl4 = nodeDisp.get( index4 , "never")
    
    ## CREO IL MODELLO DEFORMATO  ##
    pointDef1 = rg.Point3d.Clone( node.get( index1 , "never") )
    pointDef2 = rg.Point3d.Clone( node.get( index2 , "never") )
    pointDef3 = rg.Point3d.Clone( node.get( index3 , "never") )
    pointDef4 = rg.Point3d.Clone( node.get( index4 , "never") )
    
    vectortrasl1 = rg.Transform.Translation( rg.Vector3d(trasl1.X, trasl1.Y, trasl1.Z)*scaleDef )
    pointDef1.Transform( vectortrasl1 )
    vectortrasl2 = rg.Transform.Translation( rg.Vector3d(trasl2.X, trasl2.Y, trasl2.Z)*scaleDef )
    pointDef2.Transform( vectortrasl2 )
    vectortrasl3 = rg.Transform.Translation( rg.Vector3d(trasl3.X, trasl3.Y, trasl3.Z)*scaleDef )
    pointDef3.Transform( vectortrasl3 )
    vectortrasl4 = rg.Transform.Translation( rg.Vector3d(trasl4.X, trasl4.Y, trasl4.Z)*scaleDef )
    pointDef4.Transform( vectortrasl4 )

    shellDefModel = rg.Mesh()
    shellDefModel.Vertices.Add( pointDef1 ) #0
    shellDefModel.Vertices.Add( pointDef2 ) #1
    shellDefModel.Vertices.Add( pointDef3 ) #2
    shellDefModel.Vertices.Add( pointDef4 ) #3
    
    
    shellDefModel.Faces.AddFace( 0, 1, 2 )
    shellDefModel.Faces.AddFace( 0, 1, 3 )
    shellDefModel.Faces.AddFace( 1, 2, 3 )
    shellDefModel.Faces.AddFace( 0, 2, 3 )
    colour = rs.CreateColor( color[0], color[1], color[2] )
    shellDefModel.VertexColors.CreateMonotoneMesh( colour )
    
    return  [shellDefModel,[trasl1, trasl2, trasl3, trasl4]]
## node e nodeDisp son dictionary ##
def defValueTimoshenkoBeam( ele, node, nodeDisp, scaleDef ):
    #---------------- WORLD PLANE ----------------------#
    WorldPlane = rg.Plane.WorldXY
    #--------- Propriety TimoshenkoBeam  ----------------#
    TagEle = ele[0]
    propSection = ele[2]
    indexStart = ele[1][0]
    indexEnd = ele[1][1]
    #print( indexStart, indexEnd )
    color = propSection[12]
    E = propSection[1]
    G = propSection[2]
    A = propSection[3]
    Avz = propSection[4]
    Avy = propSection[5]
    Jxx = propSection[6]
    Iy = propSection[7]
    Iz = propSection[8]
    #---- traslation and rotation index start & end ------- #
    traslStart = nodeDisp.get( indexStart , "never")[0]
    rotateStart = nodeDisp.get( indexStart , "never")[1]
    traslEnd = nodeDisp.get( indexEnd , "never")[0]
    rotateEnd = nodeDisp.get( indexEnd , "never")[1]
    ##-------------------------------------------- ------------##
    pointStart = node.get( indexStart  , "never")
    pointEnd = node.get( indexEnd  , "never")
    line = rg.LineCurve( pointStart, pointEnd )
    #-------------------------versor ---------------------------#
    axis1 =  rg.Vector3d( propSection[9][0][0], propSection[9][0][1], propSection[9][0][2]  )
    axis2 =  rg.Vector3d( propSection[9][1][0], propSection[9][1][1], propSection[9][1][2]  )
    axis3 =  rg.Vector3d( propSection[9][2][0], propSection[9][2][1], propSection[9][2][2]  )
    versor = [ axis1, axis2, axis3 ] 
    #---------- WORLD PLANE on point start of line ---------------#
    traslPlane = rg.Transform.Translation( pointStart.X, pointStart.Y, pointStart.Z )
    WorldPlane.Transform( traslPlane )
    #-------------------------------------------------------------#
    planeStart = rg.Plane(pointStart, axis1, axis2 )
    #planeStart = rg.Plane(pointStart, axis3 )
    localPlane = planeStart
    xform = rg.Transform.ChangeBasis( WorldPlane, localPlane )
    localTraslStart = rg.Point3d( traslStart )
    vectorTrasform = rg.Transform.TransformList( xform, [ traslStart, rotateStart, traslEnd, rotateEnd ] )
    #print( vectorTrasform[0] )
    localTraslStart = vectorTrasform[0]
    uI1 = localTraslStart.X # spostamento in direzione dell'asse rosso 
    uI2 = localTraslStart.Y # spostamento in direzione dell'asse verde
    uI3 = localTraslStart.Z # spostamento linea d'asse
    localRotStart = vectorTrasform[1]
    rI1 = localRotStart.X # 
    rI2 = localRotStart.Y # 
    rI3 = localRotStart.Z # 
    localTraslEnd = vectorTrasform[2]
    uJ1 = localTraslEnd.X # spostamento in direzione dell'asse rosso 
    uJ2 = localTraslEnd.Y # spostamento in direzione dell'asse verde
    uJ3 = localTraslEnd.Z # spostamento linea d'asse
    localRotEnd = vectorTrasform[3]
    rJ1 = localRotEnd[0] #  
    rJ2 = localRotEnd[1]  # 
    rJ3 = localRotEnd[2]  # 
    ##------------------ displacement value -------------------------##
    Length = rg.Curve.GetLength( line )
    divideDistance = 0.5
    DivCurve = line.DivideByLength( divideDistance, True )
    if DivCurve == None:
        DivCurve = [ 0, Length]
        
    #s = dg.linspace(0,Length, len(PointsDivLength))
    AlphaY = dg.alphat( E, G, Iy, Avz )
    AlphaZ = dg.alphat( E, G, Iz, Avy )
    
    globalTransVector = []
    globalRotVector = []
    defPoint = []
    defSection = []
    #----------------------- local to global-------------------------#
    xform2 = xform.TryGetInverse()
    #----------------------------------------------------------------#
    for index, x in enumerate(DivCurve):
        beamPoint = line.PointAt(DivCurve[index]) 
        ## SPOSTAMENTO IN DIREZIONE DELL' ASSE 3 ##
        u3 = dg.spostu(x, Length, uI3, uJ3)
        u3Vector = u3*axis3
        ## SPOSTAMENTO IN DIREZIONE DELL' ASSE 1 ##
        v1 =  dg.spostv(x, Length, uI1, uJ1, rI2, rJ2, AlphaY)
        v1Vector = v1*axis1 
        ## SPOSTAMENTO IN DIREZIONE DELL' ASSE 2 ##
        v2 =  dg.spostw(x, Length, uI2, uJ2, rI1, rJ1, AlphaZ)
        v2Vector = v2*axis2 
        
        ## RISULTANTE SPOSTAMENTI ##
        transResult = v1Vector + v2Vector + u3Vector
        
        r2x =  dg.thetaz(x, Length, uI1, uJ1, rI2, rJ2, AlphaY)
        r1x =  dg.psiy(x, Length, uI2, uJ2, rI1, rJ1, AlphaZ)
        r3x = dg.phix(x, Length, rI3, rJ3)
        
        rotResult = r1x*axis1 + r2x*axis2 + r3x*axis3
        
        trasl = rg.Transform.Translation( transResult*scaleDef )
        beamPoint.Transform( trasl )
        defPoint.append( beamPoint )
        
        sectionPlane = rg.Plane( beamPoint, axis1, axis2 )
        sectionPlane.Rotate( scaleDef*r1x, axis1, beamPoint )
        sectionPlane.Rotate( scaleDef*r2x, axis2, beamPoint )
        sectionPlane.Rotate( scaleDef*r3x, axis3, beamPoint )
        if dimSection[0] == 'rectangular' :
            width, height = dimSection[1], dimSection[2]
            section = dg.AddRectangleFromCenter( sectionPlane, width, height )
            defSection.append( section )
        elif dimSection[0] == 'circular' :
            radius1  = dimSection[1]/2
            radius2  = dimSection[1]/2 - dimSection[2]
            section1 = AddCircleFromCenter( sectionPlane, radius1 )
            if (radius1 - radius2 ) == 0 :
                defSection.append( section1 )
            else :
                section2 = AddCircleFromCenter( sectionPlane, radius2 )
                defSection.append( [ section1, section2 ] )
        elif dimSection[0] == 'doubleT' :
            Bsup = dimSection[1]
            tsup = dimSection[2]
            Binf = dimSection[3]
            tinf = dimSection[4]
            H =  dimSection[5]
            ta =  dimSection[6]
            yg =  dimSection[7]
            section = AddIFromCenter( sectionPlane, Bsup, tsup, Binf, tinf, H, ta, yg )
            defSection.append( section )
        elif dimSection[0] == 'Generic' :
            radius  = dimSection[1]
            section = AddCircleFromCenter( sectionPlane, radius )
            defSection.append( section )
    
        globalTrasl = rg.Point3d( transResult ) 
        globalTrasl.Transform(xform2[1]) 
        globalTrasl.Transform(xform)
        globalTransVector.append( globalTrasl )

   
    defpolyline = rg.PolylineCurve( defPoint )

    if dimSection[0] == 'circular' :
        radius1  = dimSection[1]/2
        radius2  = dimSection[1]/2 - dimSection[2]
        if (radius1 - radius2 ) == 0:
            meshdef = meshLoft3( defSection,  color )

        else :
            defSection1 = [row[0] for row in defSection ]
            defSection2 = [row[1] for row in defSection ]
            meshdef = meshLoft3( defSection1,  color )
            meshdef.Append( meshLoft3( defSection2,  color ) )
            #print( meshdef )

    else  :
        meshdef = meshLoft3( defSection,  color )
    return  [  defpolyline, meshdef ,  globalTransVector, globalRotVector ] 

## node e nodeDisp son dictionary ##
def defTruss( ele, node, nodeDisp, scale ):
    WorldPlane = rg.Plane.WorldXY
    TagEle = ele[0]
    propSection = ele[2]
    color = propSection[12]
    indexStart = ele[1][0]
    indexEnd = ele[1][1]
    #print( indexStart, indexEnd )
    E = propSection[1]
    A = propSection[3]
    
    traslStart = nodeDisp.get( indexStart , "never")
    traslEnd = nodeDisp.get( indexEnd  , "never")
    if len( traslStart ) == 2:
        traslStart = nodeDisp.get( indexStart  , "never")[0]
        traslEnd = nodeDisp.get( indexEnd  , "never")[0]
    pointStart = node.get( indexStart  , "never")
    pointEnd = node.get( indexEnd  , "never")
    #print( traslStart[1] )
    line = rg.LineCurve( pointStart,  pointEnd )

    axis1 =  rg.Vector3d( propSection[9][0][0], propSection[9][0][1], propSection[9][0][2]  )
    axis2 =  rg.Vector3d( propSection[9][1][0], propSection[9][1][1], propSection[9][1][2]  )
    axis3 =  rg.Vector3d( propSection[9][2][0], propSection[9][2][1], propSection[9][2][2]  )
    versor = [ axis1, axis2, axis3 ] 
    #---------- WORLD PLANE on point start of line ---------------#
    traslPlane = rg.Transform.Translation( pointStart.X, pointStart.Y, pointStart.Z )
    WorldPlane.Transform( traslPlane )
    #-------------------------------------------------------------#
    planeStart = rg.Plane(pointStart, axis1, axis2 )
    #planeStart = rg.Plane(pointStart, axis3 )
    localPlane = planeStart
    xform = rg.Transform.ChangeBasis( WorldPlane, localPlane )
    localTraslStart = rg.Point3d( traslStart )
    vectorTrasform = rg.Transform.TransformList( xform, [ traslStart , traslEnd ] )
    #print( vectorTrasform[0] )
    localTraslStart = vectorTrasform[0]
    uI1 = localTraslStart.X # spostamento in direzione dell'asse rosso 
    uI2 = localTraslStart.Y # spostamento in direzione dell'asse verde
    uI3 = localTraslStart.Z # spostamento linea d'asse
    localTraslEnd = vectorTrasform[1]
    uJ1 = localTraslEnd.X # spostamento in direzione dell'asse rosso 
    uJ2 = localTraslEnd.Y # spostamento in direzione dell'asse verde
    uJ3 = localTraslEnd.Z # spostamento linea d'asse
    ##-------------- displacement value -------------------------##
    Length = rg.Curve.GetLength( line )
    divideDistance = 0.5
    DivCurve = line.DivideByLength( divideDistance, True )
    if DivCurve == None:
        DivCurve = [ 0, Length]
    defPoint = []
    defSection = []
    globalTransVector = []
    #----------------------- local to global-------------------------#
    xform2 = xform.TryGetInverse()
    #----------------------------------------------------------------#
    for index, x in enumerate(DivCurve):
        beamPoint = line.PointAt(DivCurve[index]) 
        ## SPOSTAMENTO IN DIREZIONE DELL' ASSE 3 ##
        u3 = dg.spostu(x, Length, uI3, uJ3)
        u3Vector = u3*axis3
        ## SPOSTAMENTO IN DIREZIONE DELL' ASSE 1 ##
        v1 =  x*( uJ1 - uI1 )/Length + uI1
        v1Vector = v1*axis1 
        ## SPOSTAMENTO IN DIREZIONE DELL' ASSE 2 ##
        v2 =  x*( uJ2 - uI2 )/Length + uI2
        v2Vector = v2*axis2 
        ## RISULTANTE SPOSTAMENTI ##
        transResult = v1Vector + v2Vector + u3Vector
        trasl = rg.Transform.Translation( transResult*scale )
        beamPoint.Transform( trasl )
        defPoint.append( beamPoint )
        
        sectionPlane = rg.Plane( beamPoint, axis1, axis2 )
        if dimSection[0] == 'rectangular' :
            width, height = dimSection[1], dimSection[2]
            section = dg.AddRectangleFromCenter( sectionPlane, width, height )
            defSection.append( section )
        elif dimSection[0] == 'circular' :
            radius1  = dimSection[1]/2
            radius2  = dimSection[1]/2 - dimSection[2]
            section1 = AddCircleFromCenter( sectionPlane, radius1 )
            if (radius1 - radius2 ) == 0 :
                defSection.append( section1 )
            else :
                section2 = AddCircleFromCenter( sectionPlane, radius2 )
                defSection.append( [ section1, section2 ] )
        elif dimSection[0] == 'doubleT' :
            Bsup = dimSection[1]
            tsup = dimSection[2]
            Binf = dimSection[3]
            tinf = dimSection[4]
            H =  dimSection[5]
            ta =  dimSection[6]
            yg =  dimSection[7]
            section = AddIFromCenter( sectionPlane, Bsup, tsup, Binf, tinf, H, ta, yg )
            defSection.append( section )
        elif dimSection[0] == 'Generic' :
            radius  = dimSection[1]
            section = AddCircleFromCenter( sectionPlane, radius )
            defSection.append( section )
    
        globalTrasl = rg.Point3d( transResult ) 
        globalTrasl.Transform(xform2[1]) 
        globalTrasl.Transform(xform)
        globalTransVector.append( globalTrasl )

   
    defpolyline = rg.PolylineCurve( defPoint )

    if dimSection[0] == 'circular' :
        radius1  = dimSection[1]/2
        radius2  = dimSection[1]/2 - dimSection[2]
        if (radius1 - radius2 ) == 0:
            meshdef = meshLoft3( defSection,  color )

        else :
            defSection1 = [row[0] for row in defSection ]
            defSection2 = [row[1] for row in defSection ]
            meshdef = meshLoft3( defSection1,  color )
            meshdef.Append( meshLoft3( defSection2,  color ) )
            #print( meshdef )

    else  :
        meshdef = meshLoft3( defSection,  color )
    return  [ defpolyline, meshdef, globalTransVector] 
## Mesh from close section eith gradient color ##

def meshLoft3( point, color ):
    meshElement = rg.Mesh()
    meshEle = rg.Mesh()
    pointSection1 = point
    #print( point )
    for i in range(0,len(pointSection1)):
        for j in range(0, len(pointSection1[0])):
            vertix = pointSection1[i][j]
            #print( type(vertix) )
            meshEle.Vertices.Add( vertix ) 
            #meshEle.VertexColors.Add( color[0],color[1],color[2] );
    k = len(pointSection1[0])
    for i in range(0,len(pointSection1)-1):
        for j in range(0, len(pointSection1[0])):
            if j < k-1:
                index1 = i*k + j
                index2 = (i+1)*k + j
                index3 = index2 + 1
                index4 = index1 + 1
            elif j == k-1:
                index1 = i*k + j
                index2 = (i+1)*k + j
                index3 = (i+1)*k
                index4 = i*k
            meshEle.Faces.AddFace(index1, index2, index3, index4)
            #rs.ObjectColor(scyl,(255,0,0))
    colour = rs.CreateColor( color[0], color[1], color[2] )
    meshEle.VertexColors.CreateMonotoneMesh( colour )
    meshElement = meshEle
    
    return meshElement

def updateComponent(interval):
    
    ## Updates this component, similar to using a grasshopper timer 
    
    # Define callback action
    def callBack(e):
        ghenv.Component.ExpireSolution(False)
        
    # Get grasshopper document
    ghDoc = ghenv.Component.OnPingDocument()
    
    # Schedule this component to expire
    ghDoc.ScheduleSolution(interval,gh.Kernel.GH_Document.GH_ScheduleDelegate(callBack)) # Note that the first input here is how often to update the component (in milliseconds)


#-------------------------------------------------------------------------------------#
path = openSeesOutputWrapper[0].strip()
EleOut = openSeesOutputWrapper[1]
point = openSeesOutputWrapper[2]


timeStep = []
displacement = []

start = time.clock()  


with open(path, 'r') as f:
    lines = f.readlines()
    for n, line in enumerate(lines):
        if (n % speed) == 0:
            #print( n % speed )
            line = line.strip().split(" ")
            timeStep.append( line[0] )
            displacementTemp = line[1:]
            n = 6
            displacementTime = [displacementTemp[i:i + n] for i in range(0, len(displacementTemp), n)]
            displacement.append(displacementTime)





# I change the List Structure to have an ouput
# this change will not affect the work done before

newDisplacement = [[row[i] for row in displacement] for i in range(len(displacement[0]))]

trans = []
rot = []
for nodeDispCollection in newDisplacement:
    transTemp = []
    rotTemp = []
    for nodeDisp in nodeDispCollection:
        transTemp.append(rg.Vector3d(float(nodeDisp[0]),float(nodeDisp[1]),float(nodeDisp[2])))
        rotTemp.append(rg.Vector3d(float(nodeDisp[3]),float(nodeDisp[4]),float(nodeDisp[5])))
    trans.append(transTemp)
    rot.append(rotTemp)

#for item in newDisplacement

trans = th.list_to_tree(trans)
rot = th.list_to_tree(rot)




#print(time.clock() - start)

if "myCounter" not in globals() or Reset:
    myCounter = 0

if Animate and not Reset:
    if myCounter >= len(displacement) - 1:
        myCounter = 0
    else:
        myCounter += 1
    updateComponent(1)




stepValue = displacement[myCounter]
#print( stepValue[0][0] )
pointDef = []
for indexPoint, value in enumerate(stepValue):
    tagPoint = indexPoint  + 1
    #print( tagPoint )
    traslX = float(value[0])
    traslY = float(value[1])
    traslZ = float(value[2])
    rotX = float(value[3]) 
    rotY = float(value[4])
    rotZ = float(value[5])
    pointDef.append([ tagPoint, [ rg.Point3d( traslX, traslY, traslZ ), rg.Point3d( rotX, rotY, rotZ ) ]])
timePointDef = dict( pointDef )


nodeValue = []
#ShellOut = openSeesOutputWrapper[4]

pointWrapper = []

for value in point:
    index = value[0] 
    #print( index )
    pointWrapper.append( [index, rg.Point3d(value[1][0],value[1][1],value[1][2]) ] )

## Dict. for point ##
pointWrapperDict = dict( pointWrapper )
####
scaleDef = scale

modelCurve = []
ShellDefModel = []
ExtrudedView = rg.Mesh()
modelDisp = []

traslBeamValue = []
rotBeamValue = []

traslShellValue = []
rotShellValue = []
ExtrudedShell = []

SolidDefModel = []
traslSolidValue = []

#print( timePointDef[A] )
for ele in EleOut :
    eleType = ele[2][0]
    nNode = len( ele[1] )
    
    if eleType == 'ElasticTimoshenkoBeam' :
        
        dimSection = ele[2][10]
        valueTBeam = defValueTimoshenkoBeam( ele, pointWrapperDict, timePointDef, scaleDef )
        defpolyline = valueTBeam[0]
        meshdef = valueTBeam[1]
        globalTrans = valueTBeam[2]
        globalRot = valueTBeam[3]
        traslBeamValue.append( globalTrans ) 
        rotBeamValue.append( globalRot )
        modelCurve.append( defpolyline )
        modelDisp.append( defpolyline )
        # estrusione della beam #
        ExtrudedView.Append( meshdef )
        #doc.Objects.AddMesh( meshdef )
    elif eleType == 'Truss' :
        dimSection = ele[2][10]
        #print( color )
        valueTruss = defTruss( ele, pointWrapperDict, timePointDef, scaleDef )
        defpolyline = valueTruss[0]
        meshdef = valueTruss[1]
        globalTrans = valueTruss[2]
        traslBeamValue.append( globalTrans ) 
        modelCurve.append( defpolyline )
        modelDisp.append( defpolyline )
        ExtrudedView.Append( meshdef )
        #doc.Objects.AddMesh( meshdef )

    elif nNode == 4 and eleType != 'FourNodeTetrahedron':
        shellDefModel = defShellQuad( ele, pointWrapperDict, timePointDef, scaleDef )
        ShellDefModel.append( shellDefModel[0] )
        traslShellValue.append( shellDefModel[1] )
        rotShellValue.append( shellDefModel[2] )
        extrudeShell = shellDefModel[3]
        ExtrudedView.Append( extrudeShell )

        
    elif nNode == 3:
        #print( nNode )
        shellDefModel = dg.defShellTriangle( ele, pointWrapperDict, timePointDef, scaleDef )
        ShellDefModel.append( shellDefModel[0] )
        traslShellValue.append( shellDefModel[1] )
        rotShellValue.append( shellDefModel[2] )
        extrudeShell = shellDefModel[3]
        ExtrudedView.Append( extrudeShell )
        
    elif nNode == 8:
        solidDefModel = defSolid( ele, pointWrapperDict, timePointDef, scaleDef)
        SolidDefModel.append( solidDefModel[0] )
        doc.Objects.AddMesh( solidDefModel[0] )
        traslSolidValue.append( solidDefModel[1] )
        ExtrudedView.Append( solidDefModel[0] )
        
    elif  eleType == 'FourNodeTetrahedron' :
        #print(ele)
        solidDefModel = defTetraSolid( ele, pointWrapperDict, timePointDef, scaleDef )
        SolidDefModel.append( solidDefModel[0] )
        traslSolidValue.append( solidDefModel[1] )
        ExtrudedView.Append( solidDefModel[0] )

# Max Beam #
flattenTrasl = []
for valuetrasl in traslBeamValue:
    for value in valuetrasl:
        flattenTrasl.append( value )

TraslX = [row[0] for row in flattenTrasl ]
TraslY = [row[1] for row in flattenTrasl ]
TraslZ = [row[2] for row in flattenTrasl ]

#              txMax          tyMax         tzMax
tMax = [  max(TraslX)  ,  max(TraslY) ,  max(TraslZ)  ]
#              txMin          tyMin         tzMin
tMin = [   min(TraslX) ,  min(TraslY) , min(TraslZ)  ]


if direction == 0:
    i = 0
elif direction == 1:
    i = 1
elif direction == 2:
    i = 2

def gradientJet(value, valueMax, valueMin):

    listcolo = [[0, 0, 102 ],
                [0, 0, 255],
                [0, 64, 255],
                [0, 128, 255],
                [0, 191, 255],
                [0, 255, 255],
                [0, 255, 191],
                [0, 255, 128],
                [0, 255, 64],
                [0, 255, 0],
                [64, 255, 0],
                [128, 255, 0],
                [191, 255, 0],
                [255, 255, 0],
                [255, 191, 0],
                [255, 128, 0],
                [255, 64, 0],
                [255, 0, 0],
                [230, 0, 0],
                [204, 0, 0]]

    #domain = linspace( valueMin,  valueMax, len( listcolo ) )
    n = len( listcolo )
    domain = dg.linspace( valueMin, valueMax, n)
    
    for i in range(1,n):
        if  domain[i-1] <= value <= domain[i]:
            return listcolo[ i-1 ]
        elif  valueMax <= value <= valueMax + 0.00001 :
            return listcolo[ -1 ]
        elif  valueMin - 0.00000000001 <= value <= valueMin  :
            return listcolo[ 0 ]

## Mesh from close section eith gradient color ##
def meshLoft4( point, value, valueMax, valueMin ):
    meshEle = rg.Mesh()
    for i in range(0,len(point)):
        color = gradientJet( value[i], valueMax, valueMin )
        for j in range(0, len(point[0])):
            vertix = point[i][j]
            meshEle.Vertices.Add( vertix ) 
            meshEle.VertexColors.Add( color[0],color[1],color[2] );
    k = len(point[0])
    for i in range(0,len(point)-1):
        for j in range(0, len(point[0])):
            if j < k-1:
                index1 = i*k + j
                index2 = (i+1)*k + j
                index3 = index2 + 1
                index4 = index1 + 1
            elif j == k-1:
                index1 = i*k + j
                index2 = (i+1)*k + j
                index3 = (i+1)*k
                index4 = i*k
            meshEle.Faces.AddFace(index1, index2, index3, index4)
    return meshEle

colorValor = []
numberDivide = []
for value in traslBeamValue :
    row = [row[i] for row in value ]
    numberDivide.append( len(row)  )
    for valor in row:
        color = gradientJet( valor, tMax[i], tMin[i] )
        colour = rs.CreateColor( color[0], color[1], color[2] )
        colorValor.append( colour )

for shellEle, value in zip(ShellDefModel,traslShellValue) :
    shellColor = shellEle.DuplicateMesh()
    shellColor.VertexColors.Clear()
    for j in range(0,shellEle.Vertices.Count):
        jetColor = gradientJet(value[j][i], tMax[i], tMin[i])
        print(i)
        shellColor.VertexColors.Add( jetColor[0],jetColor[1],jetColor[2] )
    modelDisp.append( shellColor)


for solidEle, value in zip(SolidDefModel,traslSolidValue) :
    solidColor = solidEle.DuplicateMesh()
    solidColor.VertexColors.Clear()
    for j in range(0,solidEle.Vertices.Count):
        jetColor = gradientJet(value[j][i], tMax[i], tMin[i])
        solidColor.VertexColors.Add( jetColor[0],jetColor[1],jetColor[2] )
    modelDisp.append( solidColor)
        #rg.Collections.MeshVertexColorList.SetColor( solidEle,j, color[0], color[1], color[2] )

max_min = th.list_to_tree([ tMax[i], tMin[i] ])

if modelExstrud == False or modelExstrud == None :
    ModelDisp  = modelDisp
    ModelCurve = th.list_to_tree([ modelCurve ,numberDivide, colorValor ])
else  :
    ModelDisp = ExtrudedView

########################################################################
# ---------- end ghpython_script_6 ----------
devec = DeconstructVector(Vector=ghpython_script_5.Trans)  # -> XComponent, YComponent, ZComponent
graph_2 = QuickGraph(devec.YComponent, SortOrder=0)

# ----
# Modal Animate
number_slider_16 = Slider(2, range=0..10)
path_8 = FilePath("C:\GitHub\Alpaca4d\PythonScript\Post-Processing\animateModal\animateModal.py")
list_11 = ValueList({"tx": 0, "ty": 1, "tz": 2}, selected="ty")
file_8 = ReadFile(File=path_8, PerLineParse=False)
max_min_2 = Max_min()

# ---- group: MODAL ANALYSIS
ghpython_script_7 = GhPythonScript(
    Code=file_8,
    OpenSeesOutputWrapper=analyze.AlpacaModalOutput,
    NumberMode=Slider(1, range=0..10),
    Speed=Slider(1, range=1..50),
    Animate=Toggle(False),
    Reset=Button(),
    Scale=number_slider_16,
    Direction=list_11,
    ModelExstrud=Toggle(True))  # -> Out, ModelDisp, ModelCurve

# ----
modeldisp_3 = ModelDisp(ghpython_script_7.ModelDisp)
explode_tree_11 = ExplodeTree(Data=ghpython_script_7.ModelCurve)  # -> Branch0, Branch1, Branch2
divide_curve_3 = DivideCurve(Curve=explode_tree_11.Branch0, Count=explode_tree_11.Branch1, Kinks=False)  # -> Points, Tangents, simplify(Parameters)
shatter_3 = Shatter(Curve=graft(explode_tree_11.Branch0), Parameters=divide_curve_3.Parameters)  # -> simplify(Segments)
curve_direction_4 = GhPythonScript(Crv=flatten(shatter_3), Thickness=Slider(3, range=0..10), RGB=explode_tree_11.Branch2)  # -> out; inputs Crv: list of Curve, RGB: list of Color; same code as curve_direction

# ---- group: Shell Stress Visualisation
# Stress view & valor
file_path_30 = FilePath("C:\GitHub\Alpaca4d\PythonScript\Post-Processing\shellStressView\shellStressView.py")  # disabled
read_file_30 = ReadFile(File=file_path_30, PerLineParse=False)  # disabled
list_12 = ValueList({"pxx": 0, "pyy": 1, "pxy": 2, "txz": 3, "tyz": 4, "mxx": 5, "myy": 6, "mxy": 7}, selected="pxx")  # disabled
python_40 = GhPythonScript(Code=read_file_30, AlpacaStaticOutput=analyze_2.AlpacaStaticOutput, StressView=list_12)  # -> Shell, StressValue; disabled
bounds_4 = Bounds(Numbers=flatten(python_40.StressValue))  # disabled
deconstruct_domain_4 = DeconstructDomain(Domain=bounds_4)  # -> Start, End; disabled
panel_24 = Panel("{0}")  # disabled
panel_25 = Panel("{0}")  # disabled
panel_26 = Panel("{0}")  # disabled

# ----
# shell Component
list_13 = ValueList({"8Color": 0, "20Color": 1}, selected="8Color")  # disabled
stressvalue = StressValue(python_40.StressValue)  # disabled
file_path_31 = FilePath("C:\GitHub\Alpaca4d\PythonScript\function\AlpacaColorMesh.py")  # disabled
read_file_31 = ReadFile(File=file_path_31, PerLineParse=False)  # disabled

# ---- group: Shell Stress Visualisation (continued)
ghpython_script_8 = GhPythonScript(
    Code=read_file_31,
    Min=deconstruct_domain_4.Start,
    Max=deconstruct_domain_4.End,
    Value=python_40.StressValue,
    NColor=list_13)  # -> Out, Color, Tag, Domain, ColorValue; disabled
split_tree_7 = SplitTree(Data=simplify(ghpython_script_8.Color), Masks=simplify(panel_24))  # -> Positive, Negative; disabled
split_tree_8 = SplitTree(Data=simplify(ghpython_script_8.Tag), Masks=simplify(panel_25))  # -> Positive, Negative; disabled
split_tree_9 = SplitTree(Data=simplify(ghpython_script_8.Domain), Masks=simplify(panel_26))  # -> Positive, Negative; disabled
mesh_colours_3 = MeshColours(Mesh=graft(python_40.Shell), Colours=ghpython_script_8.ColorValue)  # disabled
positive_3 = Positive(split_tree_8.Positive)  # disabled
positive_4 = Positive(split_tree_7.Positive)  # disabled
mesh_6 = Mesh(mesh_colours_3)  # disabled
